# Dynamo graph 01_HangingChain.dyn (Dynamo 3.0.4.7905)
# packages: DynaShape 0.9.0.0

# group: Start Point
number_slider = DoubleSlider(0, range=-5..25 step 0.1)  # graph input
number_slider_2 = DoubleSlider(0, range=-5..5 step 0.1)  # graph input
number_slider_3 = DoubleSlider(10, range=5..15 step 0.1)  # graph input
byCoordinates = Point.ByCoordinates(x=number_slider, y=number_slider_2, z=number_slider_3)

# group: End Point
number_slider_4 = DoubleSlider(20, range=-5..25 step 0.1)  # graph input
number_slider_5 = DoubleSlider(0, range=-5..5 step 0.1)  # graph input
number_slider_6 = DoubleSlider(10, range=5..15 step 0.1)  # graph input
byCoordinates_2 = Point.ByCoordinates(x=number_slider_4, y=number_slider_5, z=number_slider_6)

# group: Create Anchor goals that fix the two ends of the chain
anchorGoal_Create = DynaShape.ZeroTouch.Goals.AnchorGoal_Create(startPosition=byCoordinates)
anchorGoal_Create_2 = DynaShape.ZeroTouch.Goals.AnchorGoal_Create(startPosition=byCoordinates_2)

# group: Allow to change the anchor positions while the solver is running
number_slider_7 = DoubleSlider(0, range=-5..25 step 0.1)  # graph input
number_slider_8 = DoubleSlider(0, range=-5..5 step 0.1)  # graph input
number_slider_9 = DoubleSlider(10, range=5..15 step 0.1)  # graph input
byCoordinates_3 = Point.ByCoordinates(x=number_slider_7, y=number_slider_8, z=number_slider_9)
anchorGoal_Change = DynaShape.ZeroTouch.Goals.AnchorGoal_Change(goal=anchorGoal_Create, anchor=byCoordinates_3)
number_slider_10 = DoubleSlider(20, range=-5..25 step 0.1)  # graph input
number_slider_11 = DoubleSlider(0, range=-5..5 step 0.1)  # graph input
number_slider_12 = DoubleSlider(10, range=5..15 step 0.1)  # graph input
byCoordinates_4 = Point.ByCoordinates(x=number_slider_10, y=number_slider_11, z=number_slider_12)
anchorGoal_Change_2 = DynaShape.ZeroTouch.Goals.AnchorGoal_Change(goal=anchorGoal_Create_2, anchor=byCoordinates_4)

# group: Create a chain of nodes between the start point and end point
byStartPointEndPoint = Line.ByStartPointEndPoint(startPoint=byCoordinates, endPoint=byCoordinates_2)
integer_slider = IntegerSlider(30, range=0..100 step 1)  # graph input
code_block = CodeBlock(div=integer_slider) { t = (0..1..1/div); }
pointAtParameter = Curve.PointAtParameter(curve=byStartPointEndPoint, param=code_block)
splitByPoints = Curve.SplitByPoints(curve=byStartPointEndPoint, points=pointAtParameter)

# group: Create Length goals that try to maintain a target length for each segment
startPoint = Curve.StartPoint(curve=splitByPoints)
endPoint = Curve.EndPoint(curve=splitByPoints)
lengthGoal_Create = DynaShape.ZeroTouch.Goals.LengthGoal_Create(startPosition1=startPoint, startPosition2=endPoint)

# group: Allow to change the target length while the solver is running
number_slider_13 = DoubleSlider(0, range=0..4 step 0.1)  # graph input
lengthGoal_Change = DynaShape.ZeroTouch.Goals.LengthGoal_Change(goal=lengthGoal_Create, targetLength=number_slider_13)

# group: Create Constant goal that applied downward force to each node (to simulate gravity)
constantGoal_Create = DynaShape.ZeroTouch.Goals.ConstantGoal_Create(startPositions=pointAtParameter)

# group: Allow to change the constant force acting on each node, while the solver is running
number_slider_14 = DoubleSlider(-0.05, range=-0.2..0 step 0.01)  # graph input
byCoordinates_5 = Vector.ByCoordinates(z=number_slider_14)
constantGoal_Change = DynaShape.ZeroTouch.Goals.ConstantGoal_Change(goal=constantGoal_Create, constant=byCoordinates_5)

# group: Attach a polyline geometry to the nodes for visualization
polylineBinder = DynaShape.ZeroTouch.GeometryBinders.PolylineBinder(vertices=pointAtParameter)

# group: DynaShape Solver
create = DynaShape.ZeroTouch.Solver.Create()
join = List.Join(list0=anchorGoal_Change, list1=anchorGoal_Change_2, list2=lengthGoal_Change, list3=constantGoal_Change)
iterations = IntegerSlider(1, range=0..200 step 1)  # graph input
reset = BoolSelector(true)  # graph input
execute = BoolSelector(true)  # graph input
momentum = BoolSelector(true)  # graph input
fast_display = BoolSelector(true)  # graph input
manipulate = BoolSelector(true)  # graph input
# note: ************************************
# *** HOW TO RUN THE SOLVER ***
# 1. At the beginning of a scenario, set "reset" to True to reset the solver.
# 2. Set "reset" to False.
# 3. Set "execute" to True and see the nodes start moving to their "desired" positions as dictated by the "goals"
# (To "pause" the system at anytime, just set "execute" to False)
# 4. With "enableManipulaion" set to True, you can switch to Background View and grab and pull the nodes/vertices around
# 5. Once the system has reached the state that you like, pause the execution (i.e. by setting "execute" to False), and set "enableFastDisplay" to False so that the solver will output ACTUAL Dynamo geometry for further usage downstream
# (NOTE: The outputs of Solver.Execute node are always NULL when in FastDisplay mode)
execute_2 = DynaShape.ZeroTouch.Solver.Execute(solver=create, goals=join, geometryBinders=polylineBinder, iterations=iterations, reset=reset, execute=execute, enableMomentum=momentum, enableFastDisplay=fast_display, enableManipulation=manipulate)
watch = Watch(execute_2.geometries)
watch_2 = Watch(execute_2.nodePositions)
