# Dynamo graph 02_Tensile.dyn (Dynamo 3.0.4.7905)
# packages: DynaShape 0.9.0.0

byOrigin = CoordinateSystem.ByOrigin()
number = DoubleInput(50)  # graph input
rectangularGrid = DynaShape.ZeroTouch.Utilities.RectangularGrid(cs=byOrigin, lengthX=number, lengthY=number, divX=number, divY=number)
join = List.Join(list0=rectangularGrid.xRows, list1=rectangularGrid.yRows)

# group: Create Length goals to force the membrane to maintain its "natural" dimensions
linesFromPointSequence = DynaShape.ZeroTouch.Utilities.LinesFromPointSequence(points=join)
create = DynaShape.ZeroTouch.Goals.LengthGoal.Create(line=linesFromPointSequence@L1)

# group: Create Constant goals to simulate gravity acting on all nodes
create_2 = DynaShape.ZeroTouch.Goals.ConstantGoal.Create(startPositions=rectangularGrid.all)
number_slider = DoubleSlider(-0.5, range=-1..0 step 0.01)  # graph input
code_block = CodeBlock(z=number_slider) { vector = Vector.ByCoordinates(0, 0, z * 0.001); }
change = DynaShape.ZeroTouch.Goals.ConstantGoal.Change(constantGoal=create_2, constant=code_block)

# group: Create 4 anchor goals to fix the 4 corners of the grid
create_3 = DynaShape.ZeroTouch.Goals.AnchorGoal.Create(startPosition=rectangularGrid.corners)

# group: Suspension cable 1, simulated using a Length goal and an Anchor goal with high weight values
code_block_2 = CodeBlock { Point.ByCoordinates(0, 16, 0); Point.ByCoordinates(0, 16, 25); }
create_4 = DynaShape.ZeroTouch.Goals.LengthGoal.Create(start=code_block_2.out0, end=code_block_2.out1)
number_2 = DoubleInput(5)  # graph input
number_3 = DoubleInput(1000)  # graph input
change_2 = DynaShape.ZeroTouch.Goals.LengthGoal.Change(lengthGoal=create_4, targetLength=number_2, weight=number_3)
create_5 = DynaShape.ZeroTouch.Goals.AnchorGoal.Create(startPosition=code_block_2.out1)
number_slider_2 = DoubleSlider(-1.463, range=-38.532..100 step 0.1)  # graph input
number_slider_3 = DoubleSlider(41.097, range=-22.509..100 step 0.1)  # graph input
number_slider_4 = DoubleSlider(33.187, range=0..100 step 0.1)  # graph input
anchor_1 = Point.ByCoordinates(x=number_slider_2, y=number_slider_3, z=number_slider_4)
number_4 = DoubleInput(1000)  # graph input
change_3 = DynaShape.ZeroTouch.Goals.AnchorGoal.Change(goal=create_5, anchor=anchor_1, weight=number_4)
create_6 = List.Create(item0=change_2, item1=change_3)
code_block_3 = CodeBlock { DSCore.Color.ByARGB(255, 200, 100, 100); }
lineBinder = DynaShape.ZeroTouch.GeometryBinders.LineBinder(startPoint=code_block_2.out0, endPoint=code_block_2.out1, color=code_block_3)

# group: Suspension cable 2
code_block_4 = CodeBlock { Point.ByCoordinates(25, 0, 0); Point.ByCoordinates(25, 0, 25); }
create_7 = DynaShape.ZeroTouch.Goals.LengthGoal.Create(start=code_block_4.out0, end=code_block_4.out1)
number_5 = DoubleInput(5)  # graph input
number_6 = DoubleInput(1000)  # graph input
change_4 = DynaShape.ZeroTouch.Goals.LengthGoal.Change(lengthGoal=create_7, targetLength=number_5, weight=number_6)
create_8 = DynaShape.ZeroTouch.Goals.AnchorGoal.Create(startPosition=code_block_4.out1)
number_slider_5 = DoubleSlider(34.25, range=-38.532..100 step 0.1)  # graph input
number_slider_6 = DoubleSlider(-0.871, range=-3.347..100 step 0.1)  # graph input
number_slider_7 = DoubleSlider(36.64, range=0..100 step 0.1)  # graph input
anchor_1_2 = Point.ByCoordinates(x=number_slider_5, y=number_slider_6, z=number_slider_7)
number_7 = DoubleInput(1000)  # graph input
change_5 = DynaShape.ZeroTouch.Goals.AnchorGoal.Change(goal=create_8, anchor=anchor_1_2, weight=number_7)
create_9 = List.Create(item0=change_4, item1=change_5)
code_block_5 = CodeBlock { DSCore.Color.ByARGB(255, 200, 100, 100); }
lineBinder_2 = DynaShape.ZeroTouch.GeometryBinders.LineBinder(startPoint=code_block_4.out0, endPoint=code_block_4.out1, color=code_block_5)

# group: Suspension cable 3
code_block_6 = CodeBlock { Point.ByCoordinates(-25, 0, 0); Point.ByCoordinates(-25, 0, 25); }
create_10 = DynaShape.ZeroTouch.Goals.LengthGoal.Create(start=code_block_6.out0, end=code_block_6.out1)
number_8 = DoubleInput(5)  # graph input
number_9 = DoubleInput(1000)  # graph input
change_6 = DynaShape.ZeroTouch.Goals.LengthGoal.Change(lengthGoal=create_10, targetLength=number_8, weight=number_9)
create_11 = DynaShape.ZeroTouch.Goals.AnchorGoal.Create(startPosition=code_block_6.out1)
number_slider_8 = DoubleSlider(-44.568, range=-69.133..100 step 0.1)  # graph input
number_slider_9 = DoubleSlider(-0.871, range=-3.347..100 step 0.1)  # graph input
number_slider_10 = DoubleSlider(44.986, range=0..100 step 0.1)  # graph input
anchor_1_3 = Point.ByCoordinates(x=number_slider_8, y=number_slider_9, z=number_slider_10)
number_10 = DoubleInput(1000)  # graph input
change_7 = DynaShape.ZeroTouch.Goals.AnchorGoal.Change(goal=create_11, anchor=anchor_1_3, weight=number_10)
create_12 = List.Create(item0=change_6, item1=change_7)
code_block_7 = CodeBlock { DSCore.Color.ByARGB(255, 200, 100, 100); }
lineBinder_3 = DynaShape.ZeroTouch.GeometryBinders.LineBinder(startPoint=code_block_6.out0, endPoint=code_block_6.out1, color=code_block_7)

# group: Suspension cable 4
code_block_8 = CodeBlock { Point.ByCoordinates(0, -16, 0); Point.ByCoordinates(0, -16, 25); }
create_13 = DynaShape.ZeroTouch.Goals.LengthGoal.Create(start=code_block_8.out0, end=code_block_8.out1)
number_11 = DoubleInput(5)  # graph input
number_12 = DoubleInput(1000)  # graph input
change_8 = DynaShape.ZeroTouch.Goals.LengthGoal.Change(lengthGoal=create_13, targetLength=number_11, weight=number_12)
create_14 = DynaShape.ZeroTouch.Goals.AnchorGoal.Create(startPosition=code_block_8.out1)
number_slider_11 = DoubleSlider(0, range=-46.731..100 step 0.1)  # graph input
number_slider_12 = DoubleSlider(-31.387, range=-37.674..100 step 0.1)  # graph input
number_slider_13 = DoubleSlider(38.356, range=0..100 step 0.1)  # graph input
anchor_1_4 = Point.ByCoordinates(x=number_slider_11, y=number_slider_12, z=number_slider_13)
number_13 = DoubleInput(1000)  # graph input
change_9 = DynaShape.ZeroTouch.Goals.AnchorGoal.Change(goal=create_14, anchor=anchor_1_4, weight=number_13)
create_15 = List.Create(item0=change_8, item1=change_9)
code_block_9 = CodeBlock { DSCore.Color.ByARGB(255, 200, 100, 100); }
lineBinder_4 = DynaShape.ZeroTouch.GeometryBinders.LineBinder(startPoint=code_block_8.out0, endPoint=code_block_8.out1, color=code_block_9)

# group: Attach a polyline to each row of nodes for visualization
polylineBinder = DynaShape.ZeroTouch.GeometryBinders.PolylineBinder(vertices=join)

# group: DynaShape Solver
# note: ************************************
# *** HOW TO RUN THE SOLVER ***
# 1. At the beginning of a scenario, set "reset" to True to reset the solver.
# 2. Set "reset" to False.
# 3. Set "execute" to True and see the nodes start moving to their "desired" positions as dictated by the "goals"
# (To "pause" the system at anytime, just set "execute" to False)
# 4. With "enableManipulaion" set to True, you can switch to Background View and grab and pull the nodes/vertices around
# 5. Once the system has reached the state that you like, pause the execution (i.e. by setting "execute" to False), and set "enableFastDisplay" to False so that the solver will output ACTUAL Dynamo geometry for further usage downstream
# (NOTE: The outputs of Solver.Execute node are always NULL when in FastDisplay mode)
create_16 = DynaShape.ZeroTouch.Solver.Create()
join_2 = List.Join(list0=create, list1=change, list2=create_3, list3=create_6, list4=create_9, list5=create_12, list6=create_15)
join_3 = List.Join(list0=polylineBinder, list1=lineBinder, list2=lineBinder_2, list3=lineBinder_3, list4=lineBinder_4)
iterations = DoubleSlider(0, range=0..400 step 1)  # graph input
reset = BoolSelector(false)  # graph input
execute = BoolSelector(true)  # graph input
momentum = BoolSelector(true)  # graph input
fast_display = BoolSelector(true)  # graph input
manipulate = BoolSelector(true)  # graph input
execute_2 = DynaShape.ZeroTouch.Solver.Execute(solver=create_16, goals=join_2, geometryBinders=join_3, iterations=iterations, reset=reset, execute=execute, enableMomentum=momentum, enableFastDisplay=fast_display, enableManipulation=manipulate)
