# Dynamo graph 02c_Tensile_Large.dyn (Dynamo 3.0.4.7905)
# packages: DynaShape 0.9.0.0, MeshToolkit 5.0.0

# group: Arcs
code_block = CodeBlock { Point.ByCoordinates(-50, -20, 0); Point.ByCoordinates(0, -30, 0); Point.ByCoordinates(50, -20, 0); }
create = List.Create(item0=code_block.out0, item1=code_block.out1, item2=code_block.out2)
byPoints = NurbsCurve.ByPoints(points=create)
code_block_2 = CodeBlock { 0.1; }
code_block_3 = CodeBlock(a=code_block_2) { 1-a; }
trimByParameter = Curve.TrimByParameter(curve=byPoints, startParameter=code_block_2, endParameter=code_block_3)
number = DoubleInput(12)  # graph input
pointsAtEqualSegmentLength = Curve.PointsAtEqualSegmentLength(curve=trimByParameter, divisions=number)
code_block_4 = CodeBlock { Point.ByCoordinates(-50, -20, 0); Point.ByCoordinates(0, -7, 24); Point.ByCoordinates(50, -20, 0); }
create_2 = List.Create(item0=code_block_4.out0, item1=code_block_4.out1, item2=code_block_4.out2)
byPoints_2 = NurbsCurve.ByPoints(points=create_2)
trimByParameter_2 = Curve.TrimByParameter(curve=byPoints_2, startParameter=code_block_2, endParameter=code_block_3)
number_2 = DoubleInput(7)  # graph input
pointsAtEqualSegmentLength_2 = Curve.PointsAtEqualSegmentLength(curve=trimByParameter_2, divisions=number_2)
code_block_5 = CodeBlock { Point.ByCoordinates(-50, 20, 0); Point.ByCoordinates(0, 7, 24); Point.ByCoordinates(50, 20, 0); }
create_3 = List.Create(item0=code_block_5.out0, item1=code_block_5.out1, item2=code_block_5.out2)
byPoints_3 = NurbsCurve.ByPoints(points=create_3)
trimByParameter_3 = Curve.TrimByParameter(curve=byPoints_3, startParameter=code_block_2, endParameter=code_block_3)
pointsAtEqualSegmentLength_3 = Curve.PointsAtEqualSegmentLength(curve=trimByParameter_3, divisions=number_2)
code_block_6 = CodeBlock { Point.ByCoordinates(-50, 20, 0); Point.ByCoordinates(0, 30, 0); Point.ByCoordinates(50, 20, 0); }
create_4 = List.Create(item0=code_block_6.out0, item1=code_block_6.out1, item2=code_block_6.out2)
byPoints_4 = NurbsCurve.ByPoints(points=create_4)
trimByParameter_4 = Curve.TrimByParameter(curve=byPoints_4, startParameter=code_block_2, endParameter=code_block_3)
pointsAtEqualSegmentLength_4 = Curve.PointsAtEqualSegmentLength(curve=trimByParameter_4, divisions=number)
join = List.Join(list0=pointsAtEqualSegmentLength, list1=pointsAtEqualSegmentLength_2, list2=pointsAtEqualSegmentLength_3, list3=pointsAtEqualSegmentLength_4)

# group: Suspension cables
code_block_7 = CodeBlock()
# ---------- code_block_7.designscript (4 lines) ----------
Point.ByCoordinates(-30..30..#11, -20, 0);
Point.ByCoordinates(-30..30..#6, -6, 0);
Point.ByCoordinates(-30..30..#6, 6, 0);
Point.ByCoordinates(-30..30..#11, 20, 0);
# ----------------------------------------
join_2 = List.Join(list0=code_block_7.out0, list1=code_block_7.out1, list2=code_block_7.out2, list3=code_block_7.out3)
code_block_8 = CodeBlock(P=join_2) { Point.Translate(P, 0, 0, 1); }
byStartPointEndPoint = Line.ByStartPointEndPoint(startPoint=join_2, endPoint=code_block_8)
lengthGoal_Create = DynaShape.ZeroTouch.Goals.LengthGoal_Create(line=byStartPointEndPoint)
number_3 = DoubleInput(1)  # graph input
number_4 = DoubleInput(100)  # graph input
lengthGoal_Change = DynaShape.ZeroTouch.Goals.LengthGoal_Change(goal=lengthGoal_Create, targetLength=number_3, weight=number_4)
anchorGoal_Create = DynaShape.ZeroTouch.Goals.AnchorGoal_Create(startPosition=code_block_8)
number_5 = DoubleInput(1000)  # graph input
anchorGoal_Change = DynaShape.ZeroTouch.Goals.AnchorGoal_Change(goal=anchorGoal_Create, anchor=join, weight=number_5)
create_5 = List.Create(item0=lengthGoal_Change, item1=anchorGoal_Change)
code_block_9 = CodeBlock { DSCore.Color.ByARGB(255, 200, 100, 100); }
lineBinder = DynaShape.ZeroTouch.GeometryBinders.LineBinder(line=byStartPointEndPoint, color=code_block_9)

number_6 = DoubleInput(60)  # graph input
number_7 = DoubleInput(40)  # graph input
number_8 = DoubleInput(120)  # graph input
number_9 = DoubleInput(80)  # graph input
planeMesh = DynaShape.ZeroTouch.Utilities.PlaneMesh(lengthX=number_6, lengthY=number_7, divX=number_8, divY=number_9)
edges = Autodesk.Dynamo.MeshToolkit.Mesh.Edges(mesh=planeMesh.mesh)
length = Curve.Length(curve=edges)
number_slider = DoubleSlider(1, range=0..2 step 0.1)  # graph input
mul = length * number_slider

# group: Length goals that help the surface resist the stretching caused by pressure
lengthGoal_Create_2 = DynaShape.ZeroTouch.Goals.LengthGoal_Create(line=edges)
lengthGoal_Change_2 = DynaShape.ZeroTouch.Goals.LengthGoal_Change(goal=lengthGoal_Create_2, targetLength=mul)

vertices = Autodesk.Dynamo.MeshToolkit.Mesh.Vertices(mesh=planeMesh.mesh)

# group: Create Constant goals to simulate gravity acting on all nodes
constantGoal_Create = DynaShape.ZeroTouch.Goals.ConstantGoal_Create(startPositions=vertices)
number_slider_2 = DoubleSlider(-1, range=-20..0 step 0.01)  # graph input
code_block_10 = CodeBlock(z=number_slider_2) { vector = Vector.ByCoordinates(0, 0, z * 0.001); }
constantGoal_Change = DynaShape.ZeroTouch.Goals.ConstantGoal_Change(goal=constantGoal_Create, constant=code_block_10)

lineBinder_2 = DynaShape.ZeroTouch.GeometryBinders.LineBinder(line=edges)
meshBinder = DynaShape.ZeroTouch.GeometryBinders.MeshBinder(mesh=planeMesh.mesh)

# group: DynaShape Solver
# note: ************************************
# *** HOW TO RUN THE SOLVER ***
# 1. At the beginning of a scenario, set "reset" to True to reset the solver.
# 2. Set "reset" to False.
# 3. Set "execute" to True and see the nodes start moving to their "desired" positions as dictated by the "goals"
# (To "pause" the system at anytime, just set "execute" to False)
# 4. With "enableManipulaion" set to True, you can switch to Background View and grab and pull the nodes/vertices around
# 5. Once the system has reached the state that you like, pause the execution (i.e. by setting "execute" to False), and set "enableFastDisplay" to False so that the solver will output ACTUAL Dynamo geometry for further usage downstream
# (NOTE: The outputs of Solver.Execute node are always NULL when in FastDisplay mode)
create_6 = DynaShape.ZeroTouch.Solver.Create()
join_3 = List.Join(list0=create_5, list1=lengthGoal_Change_2, list2=constantGoal_Change)
flatten = List.Flatten(list=join_3)
join_4 = List.Join(list0=lineBinder, list1=lineBinder_2, list2=meshBinder)
flatten_2 = List.Flatten(list=join_4)
iterations = DoubleSlider(0, range=0..400 step 1)  # graph input
reset = BoolSelector(true)  # graph input
execute = BoolSelector(true)  # graph input
momentum = BoolSelector(true)  # graph input
fast_display = BoolSelector(true)  # graph input
manipulate = BoolSelector(true)  # graph input
execute_2 = DynaShape.ZeroTouch.Solver.Execute(solver=create_6, goals=flatten, geometryBinders=flatten_2, iterations=iterations, reset=reset, execute=execute, enableMomentum=momentum, enableFastDisplay=fast_display, enableManipulation=manipulate)

rectangularGrid = DynaShape.ZeroTouch.Utilities.RectangularGrid(lengthX=number_6, lengthY=number_7, divX=number_8, divY=number_9)
join_5 = List.Join(list0=rectangularGrid.xRows, list1=rectangularGrid.yRows)
linesFromPointSequence = DynaShape.ZeroTouch.Utilities.LinesFromPointSequence(points=join_5)
polylineBinder = DynaShape.ZeroTouch.GeometryBinders.PolylineBinder(vertices=join_5)

# group: Arc 3D Geometries
byStartPointEndPoint_2 = Line.ByStartPointEndPoint(startPoint=pointsAtEqualSegmentLength_2, endPoint=pointsAtEqualSegmentLength_3)
join_6 = List.Join(list0=byPoints_2, list1=byPoints_3, list2=byStartPointEndPoint_2)
planeAtParameter = Curve.PlaneAtParameter(curve=join_6)
number_10 = DoubleInput(0.15)  # graph input
byPlaneRadius = Circle.ByPlaneRadius(plane=planeAtParameter, radius=number_10)
bySweep = Surface.BySweep(profile=byPlaneRadius, path=join_6)
