# Dynamo graph 03_CatenaryShellBasic.dyn (Dynamo 3.0.4.7905)
# packages: DynaShape 0.9.0.0

byOrigin = CoordinateSystem.ByOrigin()
number = DoubleInput(50)  # graph input
number_2 = DoubleInput(50)  # graph input
rectangularGrid = DynaShape.ZeroTouch.Utilities.RectangularGrid(cs=byOrigin, lengthX=number, lengthY=number, divX=number_2, divY=number_2)

# group: Use Constant goals to similar (inversed) gravity
constantGoal_Create = DynaShape.ZeroTouch.Goals.ConstantGoal_Create(startPositions=rectangularGrid.all)
number_slider = DoubleSlider(0.0001, range=-0.005..0.005 step 0.0001)  # graph input
byCoordinates = Vector.ByCoordinates(z=number_slider)
constantGoal_Change = DynaShape.ZeroTouch.Goals.ConstantGoal_Change(goal=constantGoal_Create, constant=byCoordinates)

# group: Create Length goals to simulate 2D membrane (i.e. asking each edge to try to maintain their original length)
join = List.Join(list0=rectangularGrid.xRows, list1=rectangularGrid.yRows)
linesFromPointSequence = DynaShape.ZeroTouch.Utilities.LinesFromPointSequence(points=join)
lengthGoal_Create = DynaShape.ZeroTouch.Goals.LengthGoal_Create(line=linesFromPointSequence@L1)

# group: Fix the four corners of the membrane
anchorGoal_Create = DynaShape.ZeroTouch.Goals.AnchorGoal_Create(startPosition=rectangularGrid.corners)
boolean = BoolSelector(true)  # graph input
polylineBinder = DynaShape.ZeroTouch.GeometryBinders.PolylineBinder(vertices=rectangularGrid.quads, loop=boolean)

# group: DynaShape Solver
# note: ************************************
# *** HOW TO RUN THE SOLVER ***
# 1. At the beginning of a scenario, set "reset" to True to reset the solver.
# 2. Set "reset" to False.
# 3. Set "execute" to True and see the nodes start moving to their "desired" positions as dictated by the "goals"
# (To "pause" the system at anytime, just set "execute" to False)
# 4. With "enableManipulaion" set to True, you can switch to Background View and grab and pull the nodes/vertices around
# 5. Once the system has reached the state that you like, pause the execution (i.e. by setting "execute" to False), and set "enableFastDisplay" to False so that the solver will output ACTUAL Dynamo geometry for further usage downstream
# (NOTE: The outputs of Solver.Execute node are always NULL when in FastDisplay mode)
create = DynaShape.ZeroTouch.Solver.Create()
join_2 = List.Join(list0=constantGoal_Change, list1=lengthGoal_Create, list2=anchorGoal_Create)
iterations = IntegerSlider(0, range=0..100 step 1)  # graph input
reset = BoolSelector(true)  # graph input
execute = BoolSelector(true)  # graph input
momentum = BoolSelector(true)  # graph input
fast_display = BoolSelector(true)  # graph input
manipulate = BoolSelector(true)  # graph input
execute_2 = DynaShape.ZeroTouch.Solver.Execute(solver=create, goals=join_2, geometryBinders=polylineBinder, iterations=iterations, reset=reset, execute=execute, enableMomentum=momentum, enableFastDisplay=fast_display, enableManipulation=manipulate)
