# Dynamo graph 04_CatenaryShell.dyn (Dynamo 3.0.4.7905)
# packages: DynaShape 0.9.0.0

byOrigin = CoordinateSystem.ByOrigin()
number = DoubleInput(50)  # graph input
number_2 = DoubleInput(50)  # graph input
rectangularGrid = DynaShape.ZeroTouch.Utilities.RectangularGrid(cs=byOrigin, lengthX=number, lengthY=number, divX=number_2, divY=number_2)

# group: Use Constant goals to simulate (inversed) gravity
constantGoal_Create = DynaShape.ZeroTouch.Goals.ConstantGoal_Create(startPositions=rectangularGrid.all)
number_slider = DoubleSlider(0.005, range=0..0.02 step 0.001)  # graph input
byCoordinates = Vector.ByCoordinates(z=number_slider)
constantGoal_Change = DynaShape.ZeroTouch.Goals.ConstantGoal_Change(goal=constantGoal_Create, constant=byCoordinates)

join = List.Join(list0=rectangularGrid.xRows, list1=rectangularGrid.yRows)

# group: Create Length goals to simulate membrane
linesFromPointSequence = DynaShape.ZeroTouch.Utilities.LinesFromPointSequence(points=join)
lengthGoal_Create = DynaShape.ZeroTouch.Goals.LengthGoal_Create(line=linesFromPointSequence@L1)

# group: Create Anchor goals to fix certain parts of the membrane
number_3 = DoubleInput(2)  # graph input
getItemAtIndex = List.GetItemAtIndex(list=rectangularGrid.borders, index=number_3)
number_4 = DoubleInput(3)  # graph input
getItemAtIndex_2 = List.GetItemAtIndex(list=rectangularGrid.borders, index=number_4)
code_block = CodeBlock()
# ---------- code_block.designscript (4 lines) ----------
A = Point.ByCoordinates(25, -4, 0);
B = Point.ByCoordinates(4, -25, 0);
C = Point.ByCoordinates(25, -25, 0);
D = Point.ByCoordinates(0, 0, 0);
# ----------------------------------------
create = List.Create(item0=code_block.A, item1=code_block.B, item2=code_block.C, item3=code_block.D)
join_2 = List.Join(list0=getItemAtIndex, list1=getItemAtIndex_2, list2=create)
anchorGoal_Create = DynaShape.ZeroTouch.Goals.AnchorGoal_Create(startPosition=join_2@L1)

# group: Attach a polyline to each row of nodes for visualization
polylineBinder = DynaShape.ZeroTouch.GeometryBinders.PolylineBinder(vertices=join)

# group: DynaShape Solver
# note: ************************************
# *** HOW TO RUN THE SOLVER ***
# 1. At the beginning of a scenario, set "reset" to True to reset the solver.
# 2. Set "reset" to False.
# 3. Set "execute" to True and see the nodes start moving to their "desired" positions as dictated by the "goals"
# (To "pause" the system at anytime, just set "execute" to False)
# 4. With "enableManipulaion" set to True, you can switch to Background View and grab and pull the nodes/vertices around
# 5. Once the system has reached the state that you like, pause the execution (i.e. by setting "execute" to False), and set "enableFastDisplay" to False so that the solver will output ACTUAL Dynamo geometry for further usage downstream
# (NOTE: The outputs of Solver.Execute node are always NULL when in FastDisplay mode)
create_2 = DynaShape.ZeroTouch.Solver.Create()
join_3 = List.Join(list0=constantGoal_Change, list1=lengthGoal_Create, list2=anchorGoal_Create)
iterations = DoubleSlider(0, range=0..100 step 1)  # graph input
reset = BoolSelector(false)  # graph input
execute = BoolSelector(true)  # graph input
momentum = BoolSelector(true)  # graph input
fast_display = BoolSelector(true)  # graph input
manipulate = BoolSelector(true)  # graph input
execute_2 = DynaShape.ZeroTouch.Solver.Execute(solver=create_2, goals=join_3, geometryBinders=polylineBinder, iterations=iterations, reset=reset, execute=execute, enableMomentum=momentum, enableFastDisplay=fast_display, enableManipulation=manipulate)
