# Dynamo graph 05_HangingCloth_Wind.dyn (Dynamo 3.0.4.7905)
# packages: MeshToolkit 5.0.0, DynaShape 0.9.0.0

byOrigin = CoordinateSystem.ByOrigin()
number = DoubleInput(10)  # graph input
number_2 = DoubleInput(50)  # graph input
boolean = BoolSelector(true)  # graph input
planeMesh = DynaShape.ZeroTouch.Utilities.PlaneMesh(cs=byOrigin, lengthX=number, lengthY=number, divX=number_2, divY=number_2, alternatingDiagons=boolean)

# group: Wind
directionalWindGoal_Create = DynaShape.ZeroTouch.Goals.DirectionalWindGoal_Create(mesh=planeMesh.mesh)
number_slider = DoubleSlider(0.15, range=-0.6..0.6 step 0.01)  # graph input
number_slider_2 = DoubleSlider(-0.15, range=-0.6..0.6 step 0.01)  # graph input
number_slider_3 = DoubleSlider(0, range=-0.6..0.6 step 0.01)  # graph input
byCoordinates = Vector.ByCoordinates(x=number_slider, y=number_slider_2, z=number_slider_3)
directionalWindGoal_Change = DynaShape.ZeroTouch.Goals.DirectionalWindGoal_Change(goal=directionalWindGoal_Create, windVector=byCoordinates)

edges = Autodesk.Dynamo.MeshToolkit.Mesh.Edges(mesh=planeMesh.mesh)

# group: Create Length goals to force the edges to maintain their initial length. Notice the presence of diagonal edges in this simulation. These edges provide resistance to shearing motion (where a square got distorted into rhombus). Visually, this shearing resistance give the cloth natural-looking creases
lengthGoal_Create = DynaShape.ZeroTouch.Goals.LengthGoal_Create(line=edges)

vertices = Autodesk.Dynamo.MeshToolkit.Mesh.Vertices(mesh=planeMesh.mesh)

# group: Apply constant goals to all the nodes to simulate gravity pulling them downward
constantGoal_Create = DynaShape.ZeroTouch.Goals.ConstantGoal_Create(startPositions=vertices)
number_slider_4 = DoubleSlider(0.003, range=0..0.03 step 0.001)  # graph input
constantGoal_Change = DynaShape.ZeroTouch.Goals.ConstantGoal_Change(goal=constantGoal_Create, weight=number_slider_4)

# group: Create 3 Anchor goals to fix three corners of the cloth To "turn off" an anchor, simply set the strength/weight to 0 (even when the solver is executing)
code_block = CodeBlock()
# ---------- code_block.designscript (5 lines) ----------
A = Point.ByCoordinates(5, 5, 0);
B = Point.ByCoordinates(-5, 5, 0);
C = Point.ByCoordinates(-5, -5, 0);
D = Point.ByCoordinates(5, -5, 0);
Corners = [A, B, C, D];
# ----------------------------------------
anchorGoal_Create = DynaShape.ZeroTouch.Goals.AnchorGoal_Create(startPosition=code_block.Corners)
number_slider_5 = DoubleSlider(-1.002, range=-5..100 step 0.1)  # graph input
number_slider_6 = DoubleSlider(8.003, range=0..100 step 0.1)  # graph input
number_slider_7 = DoubleSlider(15.528, range=0..100 step 0.1)  # graph input
anchor_a = Point.ByCoordinates(x=number_slider_5, y=number_slider_6, z=number_slider_7)
number_slider_8 = DoubleSlider(-2.212, range=-4..100 step 0.1)  # graph input
number_slider_9 = DoubleSlider(-0.908, range=-1.817..100 step 0.1)  # graph input
number_slider_10 = DoubleSlider(21.38, range=0..100 step 0.1)  # graph input
anchor_b = Point.ByCoordinates(x=number_slider_8, y=number_slider_9, z=number_slider_10)
number_slider_11 = DoubleSlider(-4, range=-5..100 step 0.1)  # graph input
number_slider_12 = DoubleSlider(-5.525, range=-6.203..100 step 0.1)  # graph input
number_slider_13 = DoubleSlider(11.524, range=0..100 step 0.1)  # graph input
anchor_c = Point.ByCoordinates(x=number_slider_11, y=number_slider_12, z=number_slider_13)
create = List.Create(item0=anchor_a, item1=anchor_b, item2=anchor_c)
anchor_a_strength = DoubleInput(1000)  # graph input
anchor_b_strength = DoubleInput(1000)  # graph input
anchor_c_strength = DoubleInput(1000)  # graph input
create_2 = List.Create(item0=anchor_a_strength, item1=anchor_b_strength, item2=anchor_c_strength)
anchorGoal_Change = DynaShape.ZeroTouch.Goals.AnchorGoal_Change(goal=anchorGoal_Create, anchor=create, weight=create_2)

# group: Attach lines to the nodes for visualization
lineBinder = DynaShape.ZeroTouch.GeometryBinders.LineBinder(line=edges)

# group: DynaShape Solver
# note: ************************************
# *** HOW TO RUN THE SOLVER ***
# 1. At the beginning of a scenario, set "reset" to True to reset the solver.
# 2. Set "reset" to False.
# 3. Set "execute" to True and see the nodes start moving to their "desired" positions as dictated by the "goals"
# (To "pause" the system at anytime, just set "execute" to False)
# 4. With "enableManipulaion" set to True, you can switch to Background View and grab and pull the nodes/vertices around
# 5. Once the system has reached the state that you like, pause the execution (i.e. by setting "execute" to False), and set "enableFastDisplay" to False so that the solver will output ACTUAL Dynamo geometry for further usage downstream
# (NOTE: The outputs of Solver.Execute node are always NULL when in FastDisplay mode)
create_3 = DynaShape.ZeroTouch.Solver.Create()
all_goals = List.Join(list0=directionalWindGoal_Change, list1=lengthGoal_Create, list2=constantGoal_Change, list3=anchorGoal_Change)
iterations = DoubleSlider(0, range=0..400 step 1)  # graph input
reset = BoolSelector(true)  # graph input
execute = BoolSelector(true)  # graph input
momentum = BoolSelector(true)  # graph input
fast_display = BoolSelector(true)  # graph input
manipulate = BoolSelector(true)  # graph input
execute_2 = DynaShape.ZeroTouch.Solver.Execute(solver=create_3, goals=all_goals, geometryBinders=lineBinder, iterations=iterations, reset=reset, execute=execute, enableMomentum=momentum, enableFastDisplay=fast_display, enableManipulation=manipulate)
