# Dynamo graph 06_Cocircular_EqualLengths_.dyn (Dynamo 3.0.4.7905)
# packages: DynaShape 0.9.0.0

# group: Node starting positions
number_slider = DoubleSlider(-1.511, range=-1.511..100 step 0.1)  # graph input
number_slider_2 = DoubleSlider(2.5, range=0..100 step 0.1)  # graph input
number_slider_3 = DoubleSlider(3.029, range=-0.682..100 step 0.1)  # graph input
byCoordinates = Point.ByCoordinates(x=number_slider, y=number_slider_2, z=number_slider_3)
number_slider_4 = DoubleSlider(0.457, range=-1.943..100 step 0.1)  # graph input
number_slider_5 = DoubleSlider(5.461, range=0..100 step 0.1)  # graph input
number_slider_6 = DoubleSlider(1.785, range=0..100 step 0.1)  # graph input
byCoordinates_2 = Point.ByCoordinates(x=number_slider_4, y=number_slider_5, z=number_slider_6)
number_slider_7 = DoubleSlider(1.025, range=-1.511..100 step 0.1)  # graph input
number_slider_8 = DoubleSlider(9.3, range=0..100 step 0.1)  # graph input
number_slider_9 = DoubleSlider(3.368, range=0..100 step 0.1)  # graph input
byCoordinates_3 = Point.ByCoordinates(x=number_slider_7, y=number_slider_8, z=number_slider_9)
number_slider_10 = DoubleSlider(2.376, range=-18.013..100 step 0.1)  # graph input
number_slider_11 = DoubleSlider(14.094, range=0..100 step 0.1)  # graph input
number_slider_12 = DoubleSlider(9.98, range=-3.937..100 step 0.1)  # graph input
byCoordinates_4 = Point.ByCoordinates(x=number_slider_10, y=number_slider_11, z=number_slider_12)
number_slider_13 = DoubleSlider(6.879, range=-1.511..100 step 0.1)  # graph input
number_slider_14 = DoubleSlider(11.19, range=0..100 step 0.1)  # graph input
number_slider_15 = DoubleSlider(5.112, range=0..100 step 0.1)  # graph input
byCoordinates_5 = Point.ByCoordinates(x=number_slider_13, y=number_slider_14, z=number_slider_15)
number_slider_16 = DoubleSlider(7.65, range=-1.511..100 step 0.1)  # graph input
number_slider_17 = DoubleSlider(12.869, range=0..100 step 0.1)  # graph input
number_slider_18 = DoubleSlider(6.246, range=0..100 step 0.1)  # graph input
byCoordinates_6 = Point.ByCoordinates(x=number_slider_16, y=number_slider_17, z=number_slider_18)
number_slider_19 = DoubleSlider(9.973, range=-1.511..100 step 0.1)  # graph input
number_slider_20 = DoubleSlider(14.033, range=0..100 step 0.1)  # graph input
number_slider_21 = DoubleSlider(3.236, range=0..100 step 0.1)  # graph input
byCoordinates_7 = Point.ByCoordinates(x=number_slider_19, y=number_slider_20, z=number_slider_21)
number_slider_22 = DoubleSlider(8.324, range=-1.511..100 step 0.1)  # graph input
number_slider_23 = DoubleSlider(16.11, range=0..100 step 0.1)  # graph input
number_slider_24 = DoubleSlider(-1.942, range=-1.942..100 step 0.1)  # graph input
byCoordinates_8 = Point.ByCoordinates(x=number_slider_22, y=number_slider_23, z=number_slider_24)
create = List.Create(item0=byCoordinates, item1=byCoordinates_2, item2=byCoordinates_3, item3=byCoordinates_4, item4=byCoordinates_5, item5=byCoordinates_6, item6=byCoordinates_7, item7=byCoordinates_8)

linesFromPointSequence = DynaShape.ZeroTouch.Utilities.LinesFromPointSequence(points=create)

# group: The EqualLengths goal tries to keep the lines between each pair of nodes at the same length, while the CoCircular goal tries to force the nodes to lie on the same circular arc.
equalLengthsGoal_Create = DynaShape.ZeroTouch.Goals.EqualLengthsGoal_Create(lines=linesFromPointSequence)
coCircularGoal_Create = DynaShape.ZeroTouch.Goals.CoCircularGoal_Create(startPositions=create)
join = List.Join(list0=equalLengthsGoal_Create, list1=coCircularGoal_Create)

# group: Attach a polyline to the list of nodes for visualization
polylineBinder = DynaShape.ZeroTouch.GeometryBinders.PolylineBinder(vertices=create)

# group: DynaShape Solver
# note: ************************************
# *** HOW TO RUN THE SOLVER ***
# 1. At the beginning of a scenario, set "reset" to True to reset the solver.
# 2. Set "reset" to False.
# 3. Set "execute" to True and see the nodes start moving to their "desired" positions as dictated by the "goals"
# (To "pause" the system at anytime, just set "execute" to False)
# 4. With "enableManipulaion" set to True, you can switch to Background View and grab and pull the nodes/vertices around
# 5. Once the system has reached the state that you like, pause the execution (i.e. by setting "execute" to False), and set "enableFastDisplay" to False so that the solver will output ACTUAL Dynamo geometry for further usage downstream
# (NOTE: The outputs of Solver.Execute node are always NULL when in FastDisplay mode)
create_2 = DynaShape.ZeroTouch.Solver.Create()
iterations = DoubleSlider(0, range=0..400 step 1)  # graph input
reset = BoolSelector(true)  # graph input
execute = BoolSelector(true)  # graph input
momentum = BoolSelector(false)  # graph input
fast_display = BoolSelector(true)  # graph input
manipulate = BoolSelector(true)  # graph input
execute_2 = DynaShape.ZeroTouch.Solver.Execute(solver=create_2, goals=join, geometryBinders=polylineBinder, iterations=iterations, reset=reset, execute=execute, enableMomentum=momentum, enableFastDisplay=fast_display, enableManipulation=manipulate)
