# Dynamo graph 07_Cocircular_EqualLengths_2DGrid.dyn (Dynamo 3.0.4.7905)
# packages: DynaShape 0.9.0.0

number = DoubleInput(30)  # graph input
rectangularGrid = DynaShape.ZeroTouch.Utilities.RectangularGrid(lengthX=number, lengthY=number, divX=number, divY=number)
join = List.Join(list0=rectangularGrid.xRows, list1=rectangularGrid.yRows)
coCircularGoal_Create = DynaShape.ZeroTouch.Goals.CoCircularGoal_Create(startPositions=join)
equalLengthsGoal_Create = DynaShape.ZeroTouch.Goals.EqualLengthsGoal_Create(startPositions=join)
anchorGoal_Create = DynaShape.ZeroTouch.Goals.AnchorGoal_Create(startPosition=rectangularGrid.corners)
join_2 = List.Join(list0=coCircularGoal_Create, list1=equalLengthsGoal_Create, list2=anchorGoal_Create)
polylineBinder = DynaShape.ZeroTouch.GeometryBinders.PolylineBinder(vertices=join)

# group: DynaShape Solver
# note: ************************************
# *** HOW TO RUN THE SOLVER ***
# 1. At the beginning of a scenario, set "reset" to True to reset the solver.
# 2. Set "reset" to False.
# 3. Set "execute" to True and see the nodes start moving to their "desired" positions as dictated by the "goals"
# (To "pause" the system at anytime, just set "execute" to False)
# 4. With "enableManipulaion" set to True, you can switch to Background View and grab and pull the nodes/vertices around
# 5. Once the system has reached the state that you like, pause the execution (i.e. by setting "execute" to False), and set "enableFastDisplay" to False so that the solver will output ACTUAL Dynamo geometry for further usage downstream
# (NOTE: The outputs of Solver.Execute node are always NULL when in FastDisplay mode)
create = DynaShape.ZeroTouch.Solver.Create()
iterations = DoubleSlider(0, range=0..400 step 1)  # graph input
reset = BoolSelector(true)  # graph input
execute = BoolSelector(true)  # graph input
momentum = BoolSelector(true)  # graph input
fast_display = BoolSelector(true)  # graph input
manipulate = BoolSelector(true)  # graph input
execute_2 = DynaShape.ZeroTouch.Solver.Execute(solver=create, goals=join_2, geometryBinders=polylineBinder, iterations=iterations, reset=reset, execute=execute, enableMomentum=momentum, enableFastDisplay=fast_display, enableManipulation=manipulate)
