# Dynamo graph 08_ShapeMatching_Basic.dyn (Dynamo 3.0.4.7905)
# packages: DynaShape 0.9.0.0

# group: These points define what the target "shape" looks like. Note that these points can be adjusted while the solver is running, thanks to the ShapeMatchingGoal_Change Dynamo node
code_block = CodeBlock()
# ---------- code_block.designscript (8 lines) ----------
A = Point.ByCoordinates(0, 2, 0);
B = Point.ByCoordinates(5, 2, 0);
C = Point.ByCoordinates(6, 3, 0);
D = Point.ByCoordinates(5, 4, 0);
E = Point.ByCoordinates(0, 4, 0);
F = Point.ByCoordinates(0, 4, 3);
G = Point.ByCoordinates(0, 2, 3);
targetShapePoints = [A,B,C,D,E,F,G];
# ----------------------------------------
number = DoubleInput(1)  # graph input
boolean = BoolSelector(true)  # graph input
byControlPoints = NurbsCurve.ByControlPoints(points=code_block.targetShapePoints, degree=number, closeCurve=boolean)

# group: The starting positions of the nodes
number_slider = DoubleSlider(0.907, range=-0.762..100 step 0.1)  # graph input
number_slider_2 = DoubleSlider(5.724, range=0..100 step 0.1)  # graph input
number_slider_3 = DoubleSlider(4.898, range=0..100 step 0.1)  # graph input
byCoordinates = Point.ByCoordinates(x=number_slider, y=number_slider_2, z=number_slider_3)
number_slider_4 = DoubleSlider(3.132, range=-2.236..100 step 0.1)  # graph input
number_slider_5 = DoubleSlider(5.715, range=0..100 step 0.1)  # graph input
number_slider_6 = DoubleSlider(4.269, range=0..100 step 0.1)  # graph input
byCoordinates_2 = Point.ByCoordinates(x=number_slider_4, y=number_slider_5, z=number_slider_6)
number_slider_7 = DoubleSlider(2.803, range=0..100 step 0.1)  # graph input
number_slider_8 = DoubleSlider(6.338, range=0..100 step 0.1)  # graph input
number_slider_9 = DoubleSlider(2.148, range=0..100 step 0.1)  # graph input
byCoordinates_3 = Point.ByCoordinates(x=number_slider_7, y=number_slider_8, z=number_slider_9)
number_slider_10 = DoubleSlider(4.114, range=0..100 step 0.1)  # graph input
number_slider_11 = DoubleSlider(7.101, range=0..100 step 0.1)  # graph input
number_slider_12 = DoubleSlider(4.502, range=0..100 step 0.1)  # graph input
byCoordinates_4 = Point.ByCoordinates(x=number_slider_10, y=number_slider_11, z=number_slider_12)
number_slider_13 = DoubleSlider(0.587, range=0..100 step 0.1)  # graph input
number_slider_14 = DoubleSlider(8.324, range=0..100 step 0.1)  # graph input
number_slider_15 = DoubleSlider(4.689, range=0..100 step 0.1)  # graph input
byCoordinates_5 = Point.ByCoordinates(x=number_slider_13, y=number_slider_14, z=number_slider_15)
number_slider_16 = DoubleSlider(1.328, range=-1.864..100 step 0.1)  # graph input
number_slider_17 = DoubleSlider(8.621, range=0..100 step 0.1)  # graph input
number_slider_18 = DoubleSlider(6.822, range=0..100 step 0.1)  # graph input
byCoordinates_6 = Point.ByCoordinates(x=number_slider_16, y=number_slider_17, z=number_slider_18)
number_slider_19 = DoubleSlider(2.159, range=0..100 step 0.1)  # graph input
number_slider_20 = DoubleSlider(5.545, range=0..100 step 0.1)  # graph input
number_slider_21 = DoubleSlider(6.61, range=0..100 step 0.1)  # graph input
byCoordinates_7 = Point.ByCoordinates(x=number_slider_19, y=number_slider_20, z=number_slider_21)
create = List.Create(item0=byCoordinates, item1=byCoordinates_2, item2=byCoordinates_3, item3=byCoordinates_4, item4=byCoordinates_5, item5=byCoordinates_6, item6=byCoordinates_7)

# group: The ShapeMatching goal force a group of nodes to move into positions that resemble a target "shape" The target shape is defined by a list of points. Obviously the number of points must equal the number of nodes. In case where the target shape points are not provided, the starting positions of the nodes will be used as the target shape points (i.e. the nodes will try the maintain their relative position as defined by their starting positions)
shapeMatchingGoal_Create = DynaShape.ZeroTouch.Goals.ShapeMatchingGoal_Create(startPositions=create)
shapeMatchingGoal_Change = DynaShape.ZeroTouch.Goals.ShapeMatchingGoal_Change(goal=shapeMatchingGoal_Create, targetShapePoints=code_block.targetShapePoints)

# group: Attach a polyline to the nodes for visualization
join = List.Join(list0=create, list1=byCoordinates)
polylineBinder = DynaShape.ZeroTouch.GeometryBinders.PolylineBinder(vertices=join)

# group: DynaShape Solver
# note: ************************************
# *** HOW TO RUN THE SOLVER ***
# 1. At the beginning of a scenario, set "reset" to True to reset the solver.
# 2. Set "reset" to False.
# 3. Set "execute" to True and see the nodes start moving to their "desired" positions as dictated by the "goals"
# (To "pause" the system at anytime, just set "execute" to False)
# 4. With "enableManipulaion" set to True, you can switch to Background View and grab and pull the nodes/vertices around
# 5. Once the system has reached the state that you like, pause the execution (i.e. by setting "execute" to False), and set "enableFastDisplay" to False so that the solver will output ACTUAL Dynamo geometry for further usage downstream
# (NOTE: The outputs of Solver.Execute node are always NULL when in FastDisplay mode)
create_2 = DynaShape.ZeroTouch.Solver.Create()
iterations = DoubleSlider(0, range=0..100 step 1)  # graph input
reset = BoolSelector(true)  # graph input
execute = BoolSelector(true)  # graph input
momentum = BoolSelector(false)  # graph input
fast_display = BoolSelector(true)  # graph input
manipulate = BoolSelector(true)  # graph input
execute_2 = DynaShape.ZeroTouch.Solver.Execute(solver=create_2, goals=shapeMatchingGoal_Change, geometryBinders=polylineBinder, iterations=iterations, reset=reset, execute=execute, enableMomentum=momentum, enableFastDisplay=fast_display, enableManipulation=manipulate)
