# Dynamo graph 10_AuxeticRotatingTriangles.dyn (Dynamo 3.0.4.7905)
# packages: DynaShape 0.9.0.0

number = DoubleInput(20)  # graph input
number_2 = DoubleInput(0.3)  # graph input
auxeticRotatingTriangles = DynaShape.ZeroTouch.TestingUtilities.AuxeticRotatingTriangles(xCount=number, yCount=number, thickness=number_2)
number_3 = DoubleInput(0.01)  # graph input
mergeGoal_Change = DynaShape.ZeroTouch.Goals.MergeGoal_Change(goal=auxeticRotatingTriangles.mergeGoals, weight=number_3)

# group: DynaShape Solver
create = DynaShape.ZeroTouch.Solver.Create()
# note: ************************************
# *** HOW TO RUN THE SOLVER ***
# 1. At the beginning of a scenario, set "reset" to True to reset the solver.
# 2. Set "reset" to False.
# 3. Set "execute" to True and see the nodes start moving to their "desired" positions as dictated by the "goals"
# (To "pause" the system at anytime, just set "execute" to False)
# 4. With "enableManipulaion" set to True, you can switch to Background View and grab and pull the nodes/vertices around
# 5. Once the system has reached the state that you like, pause the execution (i.e. by setting "execute" to False), and set "enableFastDisplay" to False so that the solver will output ACTUAL Dynamo geometry for further usage downstream
# (NOTE: The outputs of Solver.Execute node are always NULL when in FastDisplay mode)
join = List.Join(list0=auxeticRotatingTriangles.shapeMatchingGoals, list1=mergeGoal_Change)
number_4 = DoubleInput(0.001)  # graph input
iterations = IntegerSlider(0, range=0..200 step 1)  # graph input
reset = BoolSelector(true)  # graph input
execute = BoolSelector(true)  # graph input
momentum = BoolSelector(true)  # graph input
fast_display = BoolSelector(true)  # graph input
manipulate = BoolSelector(true)  # graph input
execute_2 = DynaShape.ZeroTouch.Solver.Execute(solver=create, goals=join, geometryBinders=auxeticRotatingTriangles.meshBinders, nodeMergeThreshold=number_4, iterations=iterations, reset=reset, execute=execute, enableMomentum=momentum, enableFastDisplay=fast_display, enableManipulation=manipulate)
watch = Watch(execute_2.geometries)
watch_2 = Watch(execute_2.nodePositions)
