# Dynamo graph DynaSpace_Example.dyn (Dynamo 3.0.4.7905)
# packages: DynaShape 0.9.0.0

show_space_ids = BoolSelector(false)

# group: Boundary Polygon (IMPORTANT: Must be convex)
number_slider = DoubleSlider(-16.474, range=-31.212..100 step 0.1)
number_slider_2 = DoubleSlider(-29.877, range=-29.877..100 step 0.1)
byCoordinates = Point.ByCoordinates(x=number_slider, y=number_slider_2)
number_slider_3 = DoubleSlider(35.445, range=-31.212..100 step 0.1)
number_slider_4 = DoubleSlider(-29.877, range=-29.877..100 step 0.1)
byCoordinates_2 = Point.ByCoordinates(x=number_slider_3, y=number_slider_4)
number_slider_5 = DoubleSlider(39.089, range=-31.212..100 step 0.1)
number_slider_6 = DoubleSlider(13.485, range=-29.877..100 step 0.1)
byCoordinates_3 = Point.ByCoordinates(x=number_slider_5, y=number_slider_6)
number_slider_7 = DoubleSlider(31.641, range=-31.212..100 step 0.1)
number_slider_8 = DoubleSlider(34.19, range=-29.877..100 step 0.1)
byCoordinates_4 = Point.ByCoordinates(x=number_slider_7, y=number_slider_8)
number_slider_9 = DoubleSlider(-28.608, range=-31.212..100 step 0.1)
number_slider_10 = DoubleSlider(7.361, range=-29.877..100 step 0.1)
byCoordinates_5 = Point.ByCoordinates(x=number_slider_9, y=number_slider_10)
list_create = List.Create(item0=byCoordinates, item1=byCoordinates_2, item2=byCoordinates_3, item3=byCoordinates_4, item4=byCoordinates_5)
boolean = BoolSelector(true)
byPoints = PolyCurve.ByPoints(points=list_create, connectLastToFirst=boolean)

# group: Bring in the data from the CSV file
file_path = Filename(".\SampleBuildingProgram-Clinic.csv")
file_from_path = FileObject(path=file_path)
code_block = CodeBlock { "SampleBuildingProgram-Clinic"; false; }
importExcel = Data.ImportExcel(file=file_from_path, sheetName=code_block.out0, showExcel=code_block.out1)

# group: Create SpacePlanning engine from the CSV data
flatten = List.Flatten(list=importExcel)
watch = Watch(flatten)
create = DynaSpace.Engine.Create(data=watch)

# group: Clearance Polygon (IMPORTANT: Must be convex)
number_slider_11 = DoubleSlider(-8.169, range=-31.212..100 step 0.1)
number_slider_12 = DoubleSlider(-12.385, range=-29.877..100 step 0.1)
byCoordinates_6 = Point.ByCoordinates(x=number_slider_11, y=number_slider_12)
number_slider_13 = DoubleSlider(2.768, range=-31.212..100 step 0.1)
number_slider_14 = DoubleSlider(-9.81, range=-29.877..100 step 0.1)
byCoordinates_7 = Point.ByCoordinates(x=number_slider_13, y=number_slider_14)
number_slider_15 = DoubleSlider(1.569, range=-31.212..100 step 0.1)
number_slider_16 = DoubleSlider(2.406, range=-29.877..100 step 0.1)
byCoordinates_8 = Point.ByCoordinates(x=number_slider_15, y=number_slider_16)
number_slider_17 = DoubleSlider(-12.456, range=-31.212..100 step 0.1)
number_slider_18 = DoubleSlider(3.556, range=-29.877..100 step 0.1)
byCoordinates_9 = Point.ByCoordinates(x=number_slider_17, y=number_slider_18)
list_create_2 = List.Create(item0=byCoordinates_6, item1=byCoordinates_7, item2=byCoordinates_8, item3=byCoordinates_9)
boolean_2 = BoolSelector(true)
byPoints_2 = PolyCurve.ByPoints(points=list_create_2, connectLastToFirst=boolean_2)

# group: Clearance Polygon (IMPORTANT: Must be convex)
number_slider_19 = DoubleSlider(19.958, range=-31.212..100 step 0.1)
number_slider_20 = DoubleSlider(-1.624, range=-29.877..100 step 0.1)
byCoordinates_10 = Point.ByCoordinates(x=number_slider_19, y=number_slider_20)
number_slider_21 = DoubleSlider(29.008, range=-31.212..100 step 0.1)
number_slider_22 = DoubleSlider(0.13, range=-29.877..100 step 0.1)
byCoordinates_11 = Point.ByCoordinates(x=number_slider_21, y=number_slider_22)
number_slider_23 = DoubleSlider(25.072, range=-31.212..100 step 0.1)
number_slider_24 = DoubleSlider(8.741, range=-29.877..100 step 0.1)
byCoordinates_12 = Point.ByCoordinates(x=number_slider_23, y=number_slider_24)
number_slider_25 = DoubleSlider(13.945, range=-31.212..100 step 0.1)
number_slider_26 = DoubleSlider(9.691, range=-29.877..100 step 0.1)
byCoordinates_13 = Point.ByCoordinates(x=number_slider_25, y=number_slider_26)
list_create_3 = List.Create(item0=byCoordinates_10, item1=byCoordinates_11, item2=byCoordinates_12, item3=byCoordinates_13)
boolean_3 = BoolSelector(true)
byPoints_3 = PolyCurve.ByPoints(points=list_create_3, connectLastToFirst=boolean_3)

list_create_4 = List.Create(item0=list_create_2, item1=list_create_3)
# note: When Execute is False, the solver will PAUSE at the current state out put real Dynamo geometries for use further downstream
reset = BoolSelector(true)
execute = BoolSelector(true)
manipulate = BoolSelector(true)
show_adj_space_dept = BoolSelector(false)

# group: Advanced Settings
damping_factor = DoubleSlider(0, range=0..1 step 0.01)
iterations = IntegerSlider(1, range=0..100 step 1)
boundary_strength = DoubleSlider(1000, range=0..1000 step 1)
planar_constraint_strength = DoubleSlider(200, range=0..200 step 0.1)
sphere_collision_strength = DoubleSlider(100, range=0..100 step 1)
department_cohesion_strength = DoubleSlider(1, range=0..1 step 0.01)  # graph input
space_adj_strength = DoubleSlider(1, range=0..1 step 0.01)  # graph input
space_department_adj_strength = DoubleSlider(0, range=0..1 step 0.01)
create_2 = DynaSpace.Settings.Create(dampingFactor=damping_factor, iterations=iterations, boundaryStrength=boundary_strength, planarConstraintStrength=planar_constraint_strength, sphereCollisionStrength=sphere_collision_strength, departmentCohesionStrength=department_cohesion_strength, spaceAdjacencyStrength=space_adj_strength, spaceDepartmentAdjacencyStrength=space_department_adj_strength)

# group: Settings
boundary_strength_2 = DoubleSlider(1000, range=0..1000 step 0.1)
planar_constraint_strength_2 = DoubleSlider(200, range=0..200 step 0.1)
sphere_collision_strength_2 = DoubleSlider(100, range=0..100 step 0.1)
department_cohesion_strength_2 = DoubleSlider(1, range=0..1 step 0.01)
space_adjacency_strength = DoubleSlider(1, range=0..1 step 0.01)
create_3 = DynaSpace.Settings.Create(boundaryStrength=boundary_strength_2, planarConstraintStrength=planar_constraint_strength_2, sphereCollisionStrength=sphere_collision_strength_2, departmentCohesionStrength=department_cohesion_strength_2, spaceAdjacencyStrength=space_adjacency_strength)

# group: Execute the solver
execute_2 = DynaSpace.Engine.Execute(engine=create, boundaryVertices=list_create, clearancePolygonVertices=list_create_4, reset=reset, execute=execute, enableManipulation=manipulate, showSpaceAdjacency=show_adj_space_dept, showSpaceDepartmentAdjacency=create_2, settings=create_3)

watch_2 = Watch(execute_2.spaceAdjErrors)
watch_3 = Watch(execute_2.spaceAdjErrorRatios)

# group: Note: The outputs for spaces are grouped into departments
watch_4 = Watch(execute_2.spaceCircles)
watch_5 = Watch(execute_2.spaceIds)
watch_6 = Watch(execute_2.spaceNames)
watch_7 = Watch()  # unwired: arg0

watch_8 = Watch(execute_2.spaceAdjLines)
