# Dynamo graph 02a_Tensile.dyn (Dynamo 3.0.4.7905)
# packages: DynaShape 0.9.2

byOrigin = CoordinateSystem.ByOrigin()
number = DoubleInput(50)  # graph input
rectangularGrid = DynaShape.ZeroTouch.Utilities.RectangularGrid(cs=byOrigin, lengthX=number, lengthY=number, divX=number, divY=number)
join = List.Join(list0=rectangularGrid.xRows, list1=rectangularGrid.yRows)

# group: Create Length goals to force the membrane to maintain its "natural" dimensions
linesFromPointSequence = DynaShape.ZeroTouch.Utilities.LinesFromPointSequence(points=join)
flatten = List.Flatten(list=linesFromPointSequence)
number_slider = DoubleSlider(1, range=0.5..1.9 step 0.1)
byLine = DynaShape.ZeroTouch.Goals.LengthGoal.ByLine(line=flatten, targetLength=number_slider)

# group: Create Constant goals to simulate gravity acting on all nodes
number_slider_2 = DoubleSlider(-0.5, range=-1..0 step 0.01)  # graph input
code_block = CodeBlock(z=number_slider_2) { vector = Vector.ByCoordinates(0, 0, z * 0.001); }
byPoints = DynaShape.ZeroTouch.Goals.ConstantGoal.ByPoints(startPositions=join, constant=code_block)

# group: Create 4 anchor goals to fix the 4 corners of the grid
byPoint = DynaShape.ZeroTouch.Goals.AnchorGoal.ByPoint(startPosition=rectangularGrid.corners)

# group: Suspension cable 1, simulated using a Length goal and an Anchor goal with high weight values
code_block_2 = CodeBlock { Point.ByCoordinates(0, 16, 0); Point.ByCoordinates(0, 16, 25); }
number_2 = DoubleInput(5)  # graph input
number_3 = DoubleInput(1000)  # graph input
byStartPointEndPoint = DynaShape.ZeroTouch.Goals.LengthGoal.ByStartPointEndPoint(startPoint=code_block_2.out0, endPoint=code_block_2.out1, targetLength=number_2, weight=number_3)
number_slider_3 = DoubleSlider(-1.463, range=-38.532..100 step 0.1)  # graph input
number_slider_4 = DoubleSlider(41.097, range=-22.509..100 step 0.1)  # graph input
number_slider_5 = DoubleSlider(33.187, range=0..100 step 0.1)  # graph input
anchor_1 = Point.ByCoordinates(x=number_slider_3, y=number_slider_4, z=number_slider_5)
byPoint_2 = DynaShape.ZeroTouch.Goals.AnchorGoal.ByPoint(startPosition=code_block_2.out1, anchor=anchor_1)
create = List.Create(item0=byStartPointEndPoint, item1=byPoint_2)
code_block_3 = CodeBlock { DSCore.Color.ByARGB(255, 200, 100, 100); }
byStartPointEndPoint_2 = DynaShape.ZeroTouch.GeometryBinders.LineBinder.ByStartPointEndPoint(startPoint=code_block_2.out0, endPoint=code_block_2.out1, color=code_block_3)

# group: Suspension cable 2
code_block_4 = CodeBlock { Point.ByCoordinates(25, 0, 0); Point.ByCoordinates(25, 0, 25); }
number_4 = DoubleInput(5)  # graph input
number_5 = DoubleInput(1000)  # graph input
byStartPointEndPoint_3 = DynaShape.ZeroTouch.Goals.LengthGoal.ByStartPointEndPoint(startPoint=code_block_4.out0, endPoint=code_block_4.out1, targetLength=number_4, weight=number_5)
number_slider_6 = DoubleSlider(34.25, range=-38.532..100 step 0.1)  # graph input
number_slider_7 = DoubleSlider(-0.871, range=-22.509..100 step 0.1)  # graph input
number_slider_8 = DoubleSlider(36.64, range=0..100 step 0.1)  # graph input
anchor_1_2 = Point.ByCoordinates(x=number_slider_6, y=number_slider_7, z=number_slider_8)
byPoint_3 = DynaShape.ZeroTouch.Goals.AnchorGoal.ByPoint(startPosition=code_block_4.out1, anchor=anchor_1_2)
create_2 = List.Create(item0=byStartPointEndPoint_3, item1=byPoint_3)
code_block_5 = CodeBlock { DSCore.Color.ByARGB(255, 200, 100, 100); }
byStartPointEndPoint_4 = DynaShape.ZeroTouch.GeometryBinders.LineBinder.ByStartPointEndPoint(startPoint=code_block_4.out0, endPoint=code_block_4.out1, color=code_block_5)

# group: Suspension cable 3
code_block_6 = CodeBlock { Point.ByCoordinates(-25, 0, 0); Point.ByCoordinates(-25, 0, 25); }
number_6 = DoubleInput(5)  # graph input
number_7 = DoubleInput(1000)  # graph input
byStartPointEndPoint_5 = DynaShape.ZeroTouch.Goals.LengthGoal.ByStartPointEndPoint(startPoint=code_block_6.out0, endPoint=code_block_6.out1, targetLength=number_6, weight=number_7)
number_slider_9 = DoubleSlider(-44.568, range=-44.568..100 step 0.1)  # graph input
number_slider_10 = DoubleSlider(-0.871, range=-22.509..100 step 0.1)  # graph input
number_slider_11 = DoubleSlider(44.986, range=0..100 step 0.1)  # graph input
anchor_1_3 = Point.ByCoordinates(x=number_slider_9, y=number_slider_10, z=number_slider_11)
byPoint_4 = DynaShape.ZeroTouch.Goals.AnchorGoal.ByPoint(startPosition=code_block_6.out1, anchor=anchor_1_3)
create_3 = List.Create(item0=byStartPointEndPoint_5, item1=byPoint_4)
code_block_7 = CodeBlock { DSCore.Color.ByARGB(255, 200, 100, 100); }
byStartPointEndPoint_6 = DynaShape.ZeroTouch.GeometryBinders.LineBinder.ByStartPointEndPoint(startPoint=code_block_6.out0, endPoint=code_block_6.out1, color=code_block_7)

# group: Suspension cable 4
code_block_8 = CodeBlock { Point.ByCoordinates(0, -16, 0); Point.ByCoordinates(0, -16, 25); }
number_8 = DoubleInput(5)  # graph input
number_9 = DoubleInput(1000)  # graph input
byStartPointEndPoint_7 = DynaShape.ZeroTouch.Goals.LengthGoal.ByStartPointEndPoint(startPoint=code_block_8.out0, endPoint=code_block_8.out1, targetLength=number_8, weight=number_9)
number_slider_12 = DoubleSlider(0, range=-38.532..100 step 0.1)  # graph input
number_slider_13 = DoubleSlider(-31.387, range=-31.387..100 step 0.1)  # graph input
number_slider_14 = DoubleSlider(38.356, range=0..100 step 0.1)  # graph input
anchor_1_4 = Point.ByCoordinates(x=number_slider_12, y=number_slider_13, z=number_slider_14)
byPoint_5 = DynaShape.ZeroTouch.Goals.AnchorGoal.ByPoint(startPosition=code_block_8.out1, anchor=anchor_1_4)
create_4 = List.Create(item0=byStartPointEndPoint_7, item1=byPoint_5)
code_block_9 = CodeBlock { DSCore.Color.ByARGB(255, 200, 100, 100); }
byStartPointEndPoint_8 = DynaShape.ZeroTouch.GeometryBinders.LineBinder.ByStartPointEndPoint(startPoint=code_block_8.out0, endPoint=code_block_8.out1, color=code_block_9)

# group: Attach a polyline to each row of nodes for visualization
byPoints_2 = DynaShape.ZeroTouch.GeometryBinders.PolylineBinder.ByPoints(vertices=join)

# group: DynaShape Solver
# note: ************************************
# *** HOW TO RUN THE SOLVER ***
# 1. At the beginning of a scenario, set "reset" to True to reset the solver.
# 2. Set "reset" to False.
# 3. Set "execute" to True and see the nodes start moving to their "desired" positions as dictated by the "goals"
# (To "pause" the system at anytime, just set "execute" to False)
# 4. With "enableManipulaion" set to True, you can switch to Background View and grab and pull the nodes/vertices around
# 5. Once the system has reached the state that you like, pause the execution (i.e. by setting "execute" to False), and set "enableFastDisplay" to False so that the solver will output ACTUAL Dynamo geometry for further usage downstream
# (NOTE: The outputs of Solver.Execute node are always NULL when in FastDisplay mode)
join_2 = List.Join(list0=byLine, list1=byPoints, list2=byPoint, list3=create, list4=create_2, list5=create_3, list6=create_4)
join_3 = List.Join(list0=byPoints_2, list1=byStartPointEndPoint_2, list2=byStartPointEndPoint_4, list3=byStartPointEndPoint_6, list4=byStartPointEndPoint_8)
iterations = DoubleSlider(0, range=0..400 step 1)  # graph input
reset = BoolSelector(true)  # graph input
execute = BoolSelector(true)  # graph input
momentum = BoolSelector(true)  # graph input
fast_display = BoolSelector(true)  # graph input
manipulate = BoolSelector(true)  # graph input
execute_2 = DynaShape.ZeroTouch.Solver.Execute(goals=join_2, geometryBinders=join_3, iterations=iterations, reset=reset, execute=execute, enableMomentum=momentum, enableFastDisplay=fast_display, enableManipulation=manipulate)
