# Dynamo graph 03_CatenaryShellBasic.dyn (Dynamo 3.0.4.7905)
# packages: DynaShape 0.9.2

byOrigin = CoordinateSystem.ByOrigin()
number = DoubleInput(50)  # graph input
number_2 = DoubleInput(50)  # graph input
rectangularGrid = DynaShape.ZeroTouch.Utilities.RectangularGrid(cs=byOrigin, lengthX=number, lengthY=number, divX=number_2, divY=number_2)

# group: Use Constant goals to similar (inversed) gravity
number_slider = DoubleSlider(0.0001, range=-0.005..0.005 step 0.0001)  # graph input
byCoordinates = Vector.ByCoordinates(z=number_slider)
byPoints = DynaShape.ZeroTouch.Goals.ConstantGoal.ByPoints(startPositions=rectangularGrid.all, constant=byCoordinates)

# group: Create Length goals to simulate 2D membrane (i.e. asking each edge to try to maintain their original length)
join = List.Join(list0=rectangularGrid.xRows, list1=rectangularGrid.yRows)
linesFromPointSequence = DynaShape.ZeroTouch.Utilities.LinesFromPointSequence(points=join)
flatten = List.Flatten(list=linesFromPointSequence)
byLine = DynaShape.ZeroTouch.Goals.LengthGoal.ByLine(line=flatten)

# group: Fix the four corners of the membrane
byPoint = DynaShape.ZeroTouch.Goals.AnchorGoal.ByPoint(startPosition=rectangularGrid.corners)
boolean = BoolSelector(true)  # graph input
byPoints_2 = DynaShape.ZeroTouch.GeometryBinders.PolylineBinder.ByPoints(vertices=rectangularGrid.quads, loop=boolean)

# group: DynaShape Solver
# note: ************************************
# *** HOW TO RUN THE SOLVER ***
# 1. At the beginning of a scenario, set "reset" to True to reset the solver.
# 2. Set "reset" to False.
# 3. Set "execute" to True and see the nodes start moving to their "desired" positions as dictated by the "goals"
# (To "pause" the system at anytime, just set "execute" to False)
# 4. With "enableManipulaion" set to True, you can switch to Background View and grab and pull the nodes/vertices around
# 5. Once the system has reached the state that you like, pause the execution (i.e. by setting "execute" to False), and set "enableFastDisplay" to False so that the solver will output ACTUAL Dynamo geometry for further usage downstream
# (NOTE: The outputs of Solver.Execute node are always NULL when in FastDisplay mode)
join_2 = List.Join(list0=byPoints, list1=byLine, list2=byPoint)
iterations = IntegerSlider(0, range=0..100 step 1)  # graph input
reset = BoolSelector(true)  # graph input
execute = BoolSelector(true)  # graph input
momentum = BoolSelector(true)  # graph input
fast_display = BoolSelector(true)  # graph input
manipulate = BoolSelector(true)  # graph input
execute_2 = DynaShape.ZeroTouch.Solver.Execute(goals=join_2, geometryBinders=byPoints_2, iterations=iterations, reset=reset, execute=execute, enableMomentum=momentum, enableFastDisplay=fast_display, enableManipulation=manipulate)
