# Dynamo graph 04_CatenaryShell.dyn (Dynamo 3.0.4.7905)
# packages: DynaShape 0.9.2

byOrigin = CoordinateSystem.ByOrigin()
number = DoubleInput(50)  # graph input
number_2 = DoubleInput(50)  # graph input
rectangularGrid = DynaShape.ZeroTouch.Utilities.RectangularGrid(cs=byOrigin, lengthX=number, lengthY=number, divX=number_2, divY=number_2)

# group: Use Constant goals to simulate (inversed) gravity
number_slider = DoubleSlider(0.005, range=0..0.02 step 0.001)  # graph input
byCoordinates = Vector.ByCoordinates(z=number_slider)
byPoints = DynaShape.ZeroTouch.Goals.ConstantGoal.ByPoints(startPositions=rectangularGrid.all, constant=byCoordinates)

join = List.Join(list0=rectangularGrid.xRows, list1=rectangularGrid.yRows)

# group: Create Length goals to simulate membrane
linesFromPointSequence = DynaShape.ZeroTouch.Utilities.LinesFromPointSequence(points=join)
flatten = List.Flatten(list=linesFromPointSequence)
byLine = DynaShape.ZeroTouch.Goals.LengthGoal.ByLine(line=flatten)

# group: Create Anchor goals to fix certain parts of the membrane
number_3 = DoubleInput(2)  # graph input
getItemAtIndex = List.GetItemAtIndex(list=rectangularGrid.borders, index=number_3)
number_4 = DoubleInput(3)  # graph input
getItemAtIndex_2 = List.GetItemAtIndex(list=rectangularGrid.borders, index=number_4)
code_block = CodeBlock()
# ---------- code_block.designscript (4 lines) ----------
A = Point.ByCoordinates(25, -4, 0);
B = Point.ByCoordinates(4, -25, 0);
C = Point.ByCoordinates(25, -25, 0);
D = Point.ByCoordinates(0, 0, 0);
# ----------------------------------------
create = List.Create(item0=code_block.A, item1=code_block.B, item2=code_block.C, item3=code_block.D)
join_2 = List.Join(list0=getItemAtIndex, list1=getItemAtIndex_2, list2=create)
byPoint = DynaShape.ZeroTouch.Goals.AnchorGoal.ByPoint(startPosition=join_2)

# group: Attach a polyline to each row of nodes for visualization
byPoints_2 = DynaShape.ZeroTouch.GeometryBinders.PolylineBinder.ByPoints(vertices=join)

# group: DynaShape Solver
join_3 = List.Join(list0=byPoints, list1=byLine, list2=byPoint)
iterations = DoubleSlider(0, range=0..100 step 1)  # graph input
reset = BoolSelector(true)  # graph input
execute = BoolSelector(true)  # graph input
momentum = BoolSelector(true)  # graph input
fast_display = BoolSelector(true)  # graph input
manipulate = BoolSelector(true)  # graph input
# note: ************************************
# *** HOW TO RUN THE SOLVER ***
# 1. At the beginning of a scenario, set "reset" to True to reset the solver.
# 2. Set "reset" to False.
# 3. Set "execute" to True and see the nodes start moving to their "desired" positions as dictated by the "goals"
# (To "pause" the system at anytime, just set "execute" to False)
# 4. With "enableManipulaion" set to True, you can switch to Background View and grab and pull the nodes/vertices around
# 5. Once the system has reached the state that you like, pause the execution (i.e. by setting "execute" to False), and set "enableFastDisplay" to False so that the solver will output ACTUAL Dynamo geometry for further usage downstream
# (NOTE: The outputs of Solver.Execute node are always NULL when in FastDisplay mode)
execute_2 = DynaShape.ZeroTouch.Solver.Execute(goals=join_3, geometryBinders=byPoints_2, iterations=iterations, reset=reset, execute=execute, enableMomentum=momentum, enableFastDisplay=fast_display, enableManipulation=manipulate)
