# Dynamo graph 05_HangingCloth_Wind.dyn (Dynamo 3.0.4.7905)
# packages: MeshToolkit 5.0.0, DynaShape 0.9.2

byOrigin = CoordinateSystem.ByOrigin()
number = DoubleInput(10)  # graph input
number_2 = DoubleInput(50)  # graph input
boolean = BoolSelector(true)  # graph input
planeMesh = DynaShape.ZeroTouch.Utilities.PlaneMesh(cs=byOrigin, lengthX=number, lengthY=number, divX=number_2, divY=number_2, alternatingDiagons=boolean)

# group: Wind
number_slider = DoubleSlider(3, range=-3..3 step 0.01)  # graph input
number_slider_2 = DoubleSlider(-0.36, range=-0.6..0.6 step 0.01)  # graph input
number_slider_3 = DoubleSlider(0, range=-3..3 step 0.01)  # graph input
byCoordinates = Vector.ByCoordinates(x=number_slider, y=number_slider_2, z=number_slider_3)
byMesh = DynaShape.ZeroTouch.Goals.DirectionalWindGoal.ByMesh(mesh=planeMesh.mesh, windVector=byCoordinates)

edges = Autodesk.Dynamo.MeshToolkit.Mesh.Edges(mesh=planeMesh.mesh)

# group: Create Length goals to force the edges to maintain their initial length. Notice the presence of diagonal edges in this simulation. These edges provide resistance to shearing motion (where a square got distorted into rhombus). Visually, this shearing resistance give the cloth natural-looking creases
number_slider_4 = DoubleSlider(130, range=0..300 step 1)  # graph input
byLine = DynaShape.ZeroTouch.Goals.LengthGoal.ByLine(line=edges, weight=number_slider_4)

# group: Create 3 Anchor goals to fix three corners of the cloth To "turn off" an anchor, simply set the strength/weight to 0 (even when the solver is executing)
code_block = CodeBlock()
# ---------- code_block.designscript (4 lines) ----------
A = Point.ByCoordinates(5, 5, 0);
B = Point.ByCoordinates(-5, 5, 0);
C = Point.ByCoordinates(-5, -5, 0);
Corners = [A, B, C];
# ----------------------------------------
number_slider_5 = DoubleSlider(1.9, range=-5..100 step 0.1)  # graph input
number_slider_6 = DoubleSlider(8.003, range=0..100 step 0.1)  # graph input
number_slider_7 = DoubleSlider(15.528, range=0..100 step 0.1)  # graph input
anchor_a = Point.ByCoordinates(x=number_slider_5, y=number_slider_6, z=number_slider_7)
number_slider_8 = DoubleSlider(-4, range=-4..100 step 0.1)  # graph input
number_slider_9 = DoubleSlider(-0.908, range=-1.817..100 step 0.1)  # graph input
number_slider_10 = DoubleSlider(21.38, range=0..100 step 0.1)  # graph input
anchor_b = Point.ByCoordinates(x=number_slider_8, y=number_slider_9, z=number_slider_10)
number_slider_11 = DoubleSlider(-0.7, range=-5..100 step 0.1)  # graph input
number_slider_12 = DoubleSlider(-5.525, range=-6.203..100 step 0.1)  # graph input
number_slider_13 = DoubleSlider(11.524, range=0..100 step 0.1)  # graph input
anchor_c = Point.ByCoordinates(x=number_slider_11, y=number_slider_12, z=number_slider_13)
create = List.Create(item0=anchor_a, item1=anchor_b, item2=anchor_c)
anchor_a_strength = DoubleInput(1000)  # graph input
anchor_b_strength = DoubleInput(1000)  # graph input
anchor_c_strength = DoubleInput(1000)  # graph input
create_2 = List.Create(item0=anchor_a_strength, item1=anchor_b_strength, item2=anchor_c_strength)
byPoint = DynaShape.ZeroTouch.Goals.AnchorGoal.ByPoint(startPosition=code_block.Corners, anchor=create, weight=create_2)

# group: Apply constant goals to all the nodes to simulate gravity pulling them downward
vertices = Autodesk.Dynamo.MeshToolkit.Mesh.Vertices(mesh=planeMesh.mesh)
number_slider_14 = DoubleSlider(0.00012, range=0..0.0005 step 1e-05)  # graph input
code_block_2 = CodeBlock(z=number_slider_14) { Vector.ByCoordinates(0, 0, -z); }
byPoints = DynaShape.ZeroTouch.Goals.ConstantGoal.ByPoints(startPositions=vertices, constant=code_block_2)

# group: Attach lines to the nodes for visualization
byLine_2 = DynaShape.ZeroTouch.GeometryBinders.LineBinder.ByLine(line=edges)

# group: DynaShape Solver
all_goals = List.Join(list0=byMesh, list1=byLine, list2=byPoint, list3=byPoints)
iterations = DoubleSlider(0, range=0..400 step 1)  # graph input
reset = BoolSelector(true)  # graph input
execute = BoolSelector(true)  # graph input
# note: ************************************
# *** HOW TO RUN THE SOLVER ***
# 1. At the beginning of a scenario, set "reset" to True to reset the solver.
# 2. Set "reset" to False.
# 3. Set "execute" to True and see the nodes start moving to their "desired" positions as dictated by the "goals"
# (To "pause" the system at anytime, just set "execute" to False)
# 4. With "enableManipulaion" set to True, you can switch to Background View and grab and pull the nodes/vertices around
# 5. Once the system has reached the state that you like, pause the execution (i.e. by setting "execute" to False), and set "enableFastDisplay" to False so that the solver will output ACTUAL Dynamo geometry for further usage downstream
# (NOTE: The outputs of Solver.Execute node are always NULL when in FastDisplay mode)
momentum = BoolSelector(true)  # graph input
fast_display = BoolSelector(true)  # graph input
manipulate = BoolSelector(true)  # graph input
execute_2 = DynaShape.ZeroTouch.Solver.Execute(goals=all_goals, geometryBinders=byLine_2, iterations=iterations, reset=reset, execute=execute, enableMomentum=momentum, enableFastDisplay=fast_display, enableManipulation=manipulate)
