# Dynamo graph 11_ConstantVolumePressure.dyn (Dynamo 3.0.4.7905)
# packages: MeshToolkit 5.0.0, DynaShape 0.9.2

number = DoubleInput(2)  # graph input
number_2 = DoubleInput(10)  # graph input
cuboid = Autodesk.Dynamo.MeshToolkit.Mesh.Cuboid(length=number, width=number, height=number, xDivisions=number_2, yDivisions=number_2, zDivisions=number_2)

# group: Pressure goal: Push each mesh vertices outward along the direction of the vertex normal. This goal is based on Boyle's law, which basically states that pressure is inversely proportional to volume (i.e. the pressure strength decreases as volume increases)
number_slider = DoubleSlider(5, range=5..30 step 0.001)  # graph input
byMesh = DynaShape.ZeroTouch.Goals.ConstantVolumePressureGoal.ByMesh(mesh=cuboid, volumePressureConstant=number_slider)

edges = Autodesk.Dynamo.MeshToolkit.Mesh.Edges(mesh=cuboid)

# group: Length goals that help the surface resist the stretching caused by pressure
byLine = DynaShape.ZeroTouch.Goals.LengthGoal.ByLine(line=edges)

# group: Line binders for visualization
byLine_2 = DynaShape.ZeroTouch.GeometryBinders.LineBinder.ByLine(line=edges)

# group: DynaShape Solver
join = List.Join(list0=byMesh, list1=byLine)
iterations = DoubleSlider(0, range=0..100 step 1)  # graph input
reset = BoolSelector(true)  # graph input
execute = BoolSelector(true)  # graph input
# note: ************************************
# *** HOW TO RUN THE SOLVER ***
# 1. At the beginning of a scenario, set "reset" to True to reset the solver.
# 2. Set "reset" to False.
# 3. Set "execute" to True and see the nodes start moving to their "desired" positions as dictated by the "goals"
# (To "pause" the system at anytime, just set "execute" to False)
# 4. With "enableManipulaion" set to True, you can switch to Background View and grab and pull the nodes/vertices around
# 5. Once the system has reached the state that you like, pause the execution (i.e. by setting "execute" to False), and set "enableFastDisplay" to False so that the solver will output ACTUAL Dynamo geometry for further usage downstream
# (NOTE: The outputs of Solver.Execute node are always NULL when in FastDisplay mode)
momentum = BoolSelector(true)  # graph input
fast_display = BoolSelector(true)  # graph input
manipulate = BoolSelector(true)  # graph input
execute_2 = DynaShape.ZeroTouch.Solver.Execute(goals=join, geometryBinders=byLine_2, iterations=iterations, reset=reset, execute=execute, enableMomentum=momentum, enableFastDisplay=fast_display, enableManipulation=manipulate)
