# Dynamo graph 01_HangingChain.dyn (Dynamo 3.0.4.7905)
# packages: DynaShape 0.9.2

# group: Start Point
number_slider = DoubleSlider(0, range=-5..25 step 0.1)  # graph input
number_slider_2 = DoubleSlider(0, range=-5..5 step 0.1)  # graph input
number_slider_3 = DoubleSlider(10, range=5..15 step 0.1)  # graph input
byCoordinates = Point.ByCoordinates(x=number_slider, y=number_slider_2, z=number_slider_3)

# group: End Point
number_slider_4 = DoubleSlider(20, range=-5..25 step 0.1)  # graph input
number_slider_5 = DoubleSlider(0, range=-5..5 step 0.1)  # graph input
number_slider_6 = DoubleSlider(10, range=5..15 step 0.1)  # graph input
byCoordinates_2 = Point.ByCoordinates(x=number_slider_4, y=number_slider_5, z=number_slider_6)

# group: Create Anchor goals that fix the two ends of the chain
create = DynaShape.ZeroTouch.Goals.AnchorGoal.Create(startPosition=byCoordinates)
create_2 = DynaShape.ZeroTouch.Goals.AnchorGoal.Create(startPosition=byCoordinates_2)

# group: Allow to change the anchor positions while the solver is running
number_slider_7 = DoubleSlider(0, range=-5..25 step 0.1)  # graph input
number_slider_8 = DoubleSlider(0, range=-5..5 step 0.1)  # graph input
number_slider_9 = DoubleSlider(10, range=5..15 step 0.1)  # graph input
byCoordinates_3 = Point.ByCoordinates(x=number_slider_7, y=number_slider_8, z=number_slider_9)
change = DynaShape.ZeroTouch.Goals.AnchorGoal.Change(goal=create, anchor=byCoordinates_3)
number_slider_10 = DoubleSlider(20, range=-5..25 step 0.1)  # graph input
number_slider_11 = DoubleSlider(0, range=-5..5 step 0.1)  # graph input
number_slider_12 = DoubleSlider(10, range=5..15 step 0.1)  # graph input
byCoordinates_4 = Point.ByCoordinates(x=number_slider_10, y=number_slider_11, z=number_slider_12)
change_2 = DynaShape.ZeroTouch.Goals.AnchorGoal.Change(goal=create_2, anchor=byCoordinates_4)

# group: Create a chain of nodes between the start point and end point
byStartPointEndPoint = Line.ByStartPointEndPoint(startPoint=byCoordinates, endPoint=byCoordinates_2)
integer_slider = IntegerSlider(30, range=0..100 step 1)  # graph input
code_block = CodeBlock(div=integer_slider) { t = (0..1..1/div); }
pointAtParameter = Curve.PointAtParameter(curve=byStartPointEndPoint, param=code_block)
splitByPoints = Curve.SplitByPoints(curve=byStartPointEndPoint, points=pointAtParameter)

# group: Create Length goals that try to maintain a target length for each segment
startPoint = Curve.StartPoint(curve=splitByPoints)
endPoint = Curve.EndPoint(curve=splitByPoints)
byStartEnd = DynaShape.ZeroTouch.Goals.LengthGoal.ByStartEnd(start=startPoint, end=endPoint)

# group: Allow to change the target length while the solver is running
number_slider_13 = DoubleSlider(0, range=0..4 step 0.1)  # graph input
change_3 = DynaShape.ZeroTouch.Goals.LengthGoal.Change(lengthGoal=byStartEnd, targetLength=number_slider_13)

# group: Create Constant goal that applied downward force to each node (to simulate gravity)
create_3 = DynaShape.ZeroTouch.Goals.ConstantGoal.Create(startPositions=pointAtParameter)

# group: Allow to change the constant force acting on each node, while the solver is running
number_slider_14 = DoubleSlider(-0.05, range=-0.2..0 step 0.01)  # graph input
byCoordinates_5 = Vector.ByCoordinates(z=number_slider_14)
change_4 = DynaShape.ZeroTouch.Goals.ConstantGoal.Change(constantGoal=create_3, constant=byCoordinates_5)

# group: Attach a polyline geometry to the nodes for visualization
polylineBinder = DynaShape.ZeroTouch.GeometryBinders.PolylineBinder(vertices=pointAtParameter)

# group: DynaShape Solver
create_4 = DynaShape.ZeroTouch.Solver.Create()
join = List.Join(list0=change, list1=change_2, list2=change_3, list3=change_4)
iterations = IntegerSlider(1, range=0..200 step 1)  # graph input
reset = BoolSelector(true)  # graph input
execute = BoolSelector(true)  # graph input
momentum = BoolSelector(true)  # graph input
fast_display = BoolSelector(true)  # graph input
manipulate = BoolSelector(true)  # graph input
# note: ************************************
# *** HOW TO RUN THE SOLVER ***
# 1. At the beginning of a scenario, set "reset" to True to reset the solver.
# 2. Set "reset" to False.
# 3. Set "execute" to True and see the nodes start moving to their "desired" positions as dictated by the "goals"
# (To "pause" the system at anytime, just set "execute" to False)
# 4. With "enableManipulaion" set to True, you can switch to Background View and grab and pull the nodes/vertices around
# 5. Once the system has reached the state that you like, pause the execution (i.e. by setting "execute" to False), and set "enableFastDisplay" to False so that the solver will output ACTUAL Dynamo geometry for further usage downstream
# (NOTE: The outputs of Solver.Execute node are always NULL when in FastDisplay mode)
execute_2 = DynaShape.ZeroTouch.Solver.Execute(solver=create_4, goals=join, geometryBinders=polylineBinder, iterations=iterations, reset=reset, execute=execute, enableMomentum=momentum, enableFastDisplay=fast_display, enableManipulation=manipulate)
watch = Watch(execute_2.geometries)
watch_2 = Watch(execute_2.nodePositions)
