# Dynamo graph 02c_Tensile_Large.dyn (Dynamo 3.0.4.7905)
# packages: DynaShape 0.9.2, MeshToolkit 5.0.0

# group: Arcs
code_block = CodeBlock { Point.ByCoordinates(-50, -20, 0); Point.ByCoordinates(0, -7, 24); Point.ByCoordinates(50, -20, 0); }
create = List.Create(item0=code_block.out0, item1=code_block.out1, item2=code_block.out2)
byPoints = NurbsCurve.ByPoints(points=create)
code_block_2 = CodeBlock { Point.ByCoordinates(-50, 20, 0); Point.ByCoordinates(0, 7, 24); Point.ByCoordinates(50, 20, 0); }
create_2 = List.Create(item0=code_block_2.out0, item1=code_block_2.out1, item2=code_block_2.out2)
byPoints_2 = NurbsCurve.ByPoints(points=create_2)
code_block_3 = CodeBlock { 0.1; }
code_block_4 = CodeBlock(a=code_block_3) { 1-a; }
trimByParameter = Curve.TrimByParameter(curve=byPoints, startParameter=code_block_3, endParameter=code_block_4)
number = DoubleInput(7)  # graph input
pointsAtEqualSegmentLength = Curve.PointsAtEqualSegmentLength(curve=trimByParameter, divisions=number)
trimByParameter_2 = Curve.TrimByParameter(curve=byPoints_2, startParameter=code_block_3, endParameter=code_block_4)
pointsAtEqualSegmentLength_2 = Curve.PointsAtEqualSegmentLength(curve=trimByParameter_2, divisions=number)
code_block_5 = CodeBlock { Point.ByCoordinates(-50, -20, 0); Point.ByCoordinates(0, -30, 0); Point.ByCoordinates(50, -20, 0); }
create_3 = List.Create(item0=code_block_5.out0, item1=code_block_5.out1, item2=code_block_5.out2)
byPoints_3 = NurbsCurve.ByPoints(points=create_3)
trimByParameter_3 = Curve.TrimByParameter(curve=byPoints_3, startParameter=code_block_3, endParameter=code_block_4)
number_2 = DoubleInput(12)  # graph input
pointsAtEqualSegmentLength_3 = Curve.PointsAtEqualSegmentLength(curve=trimByParameter_3, divisions=number_2)
code_block_6 = CodeBlock { Point.ByCoordinates(-50, 20, 0); Point.ByCoordinates(0, 30, 0); Point.ByCoordinates(50, 20, 0); }
create_4 = List.Create(item0=code_block_6.out0, item1=code_block_6.out1, item2=code_block_6.out2)
byPoints_4 = NurbsCurve.ByPoints(points=create_4)
trimByParameter_4 = Curve.TrimByParameter(curve=byPoints_4, startParameter=code_block_3, endParameter=code_block_4)
pointsAtEqualSegmentLength_4 = Curve.PointsAtEqualSegmentLength(curve=trimByParameter_4, divisions=number_2)
join = List.Join(list0=pointsAtEqualSegmentLength_3, list1=pointsAtEqualSegmentLength, list2=pointsAtEqualSegmentLength_2, list3=pointsAtEqualSegmentLength_4)

# group: Arc 3D Geometries
byStartPointEndPoint = Line.ByStartPointEndPoint(startPoint=pointsAtEqualSegmentLength, endPoint=pointsAtEqualSegmentLength_2)
join_2 = List.Join(list0=byPoints, list1=byPoints_2, list2=byStartPointEndPoint)
planeAtParameter = Curve.PlaneAtParameter(curve=join_2)
number_3 = DoubleInput(0.15)  # graph input
byPlaneRadius = Circle.ByPlaneRadius(plane=planeAtParameter, radius=number_3)
bySweep = Surface.BySweep(profile=byPlaneRadius, path=join_2)

# group: Suspension cables
code_block_7 = CodeBlock()
# ---------- code_block_7.designscript (4 lines) ----------
Point.ByCoordinates(-30..30..#11, -20, 0);
Point.ByCoordinates(-30..30..#6, -6, 0);
Point.ByCoordinates(-30..30..#6, 6, 0);
Point.ByCoordinates(-30..30..#11, 20, 0);
# ----------------------------------------
join_3 = List.Join(list0=code_block_7.out0, list1=code_block_7.out1, list2=code_block_7.out2, list3=code_block_7.out3)
code_block_8 = CodeBlock(P=join_3) { Point.Translate(P, 0, 0, 1); }
byStartPointEndPoint_2 = Line.ByStartPointEndPoint(startPoint=join_3, endPoint=code_block_8)
number_4 = DoubleInput(1)  # graph input
number_5 = DoubleInput(100)  # graph input
byLine = DynaShape.ZeroTouch.Goals.LengthGoal.ByLine(line=byStartPointEndPoint_2, targetLength=number_4, weight=number_5)
byPoint = DynaShape.ZeroTouch.Goals.AnchorGoal.ByPoint(startPosition=code_block_8, anchor=join)
create_5 = List.Create(item0=byLine, item1=byPoint)
code_block_9 = CodeBlock { DSCore.Color.ByARGB(255, 200, 100, 100); }
byLine_2 = DynaShape.ZeroTouch.GeometryBinders.LineBinder.ByLine(line=byStartPointEndPoint_2, color=code_block_9)

# group: Initial mesh
number_6 = DoubleInput(60)  # graph input
number_7 = DoubleInput(40)  # graph input
number_8 = DoubleInput(120)  # graph input
number_9 = DoubleInput(80)  # graph input
planeMesh = DynaShape.ZeroTouch.Utilities.PlaneMesh(lengthX=number_6, lengthY=number_7, divX=number_8, divY=number_9)

edges = Autodesk.Dynamo.MeshToolkit.Mesh.Edges(mesh=planeMesh.mesh)

# group: Length goals that help the surface resist the stretching caused by pressure
length = Curve.Length(curve=edges)
number_slider = DoubleSlider(1, range=0..2 step 0.1)  # graph input
mul = length * number_slider
byLine_3 = DynaShape.ZeroTouch.Goals.LengthGoal.ByLine(line=edges, targetLength=mul)

# group: Create Constant goals to simulate gravity acting on all nodes
vertices = Autodesk.Dynamo.MeshToolkit.Mesh.Vertices(mesh=planeMesh.mesh)
number_slider_2 = DoubleSlider(-1, range=-20..0 step 0.01)  # graph input
code_block_10 = CodeBlock(z=number_slider_2) { vector = Vector.ByCoordinates(0, 0, z * 0.001); }
byPoints_5 = DynaShape.ZeroTouch.Goals.ConstantGoal.ByPoints(startPositions=vertices, constant=code_block_10)

byLine_4 = DynaShape.ZeroTouch.GeometryBinders.LineBinder.ByLine(line=edges)
byMesh = DynaShape.ZeroTouch.GeometryBinders.MeshBinder.ByMesh(mesh=planeMesh.mesh)

# group: DynaShape Solver
momentum = BoolSelector(true)  # graph input
fast_display = BoolSelector(true)  # graph input
join_4 = List.Join(list0=create_5, list1=byLine_3, list2=byPoints_5)
# note: ************************************
# *** HOW TO RUN THE SOLVER ***
# 1. At the beginning of a scenario, set "reset" to True to reset the solver.
# 2. Set "reset" to False.
# 3. Set "execute" to True and see the nodes start moving to their "desired" positions as dictated by the "goals"
# (To "pause" the system at anytime, just set "execute" to False)
# 4. With "enableManipulaion" set to True, you can switch to Background View and grab and pull the nodes/vertices around
# 5. Once the system has reached the state that you like, pause the execution (i.e. by setting "execute" to False), and set "enableFastDisplay" to False so that the solver will output ACTUAL Dynamo geometry for further usage downstream
# (NOTE: The outputs of Solver.Execute node are always NULL when in FastDisplay mode)
flatten = List.Flatten(list=join_4)
join_5 = List.Join(list0=byLine_2, list1=byLine_4, list2=byMesh)
flatten_2 = List.Flatten(list=join_5)
iterations = DoubleSlider(0, range=0..400 step 1)  # graph input
reset = BoolSelector(true)  # graph input
execute = BoolSelector(true)  # graph input
manipulate = BoolSelector(true)  # graph input
execute_2 = DynaShape.ZeroTouch.Solver.Execute(goals=flatten, geometryBinders=flatten_2, iterations=iterations, reset=reset, execute=execute, enableManipulation=manipulate)
