# Dynamo graph 09_AuxeticRotatingSquares.dyn (Dynamo 3.0.4.7905)
# packages: DynaShape 0.9.0.0

number = DoubleInput(50)  # graph input
number_2 = DoubleInput(0.15)  # graph input
auxeticRotatingSquares = DynaShape.ZeroTouch.TestingUtilities.AuxeticRotatingSquares(xCount=number, yCount=number, thickness=number_2)

# group: DynaShape Solver
create = DynaShape.ZeroTouch.Solver.Create()
join = List.Join(list0=auxeticRotatingSquares.shapeMatchingGoals)
join_2 = List.Join(list0=auxeticRotatingSquares.meshBinders, list1=auxeticRotatingSquares.lineBinders)
iterations = IntegerSlider(0, range=0..200 step 1)  # graph input
reset = BoolSelector(true)  # graph input
execute = BoolSelector(true)  # graph input
momentum = BoolSelector(true)  # graph input
fast_display = BoolSelector(true)  # graph input
manipulate = BoolSelector(true)  # graph input
# note: ************************************
# *** HOW TO RUN THE SOLVER ***
# 1. At the beginning of a scenario, set "reset" to True to reset the solver.
# 2. Set "reset" to False.
# 3. Set "execute" to True and see the nodes start moving to their "desired" positions as dictated by the "goals"
# (To "pause" the system at anytime, just set "execute" to False)
# 4. With "enableManipulaion" set to True, you can switch to Background View and grab and pull the nodes/vertices around
# 5. Once the system has reached the state that you like, pause the execution (i.e. by setting "execute" to False), and set "enableFastDisplay" to False so that the solver will output ACTUAL Dynamo geometry for further usage downstream
# (NOTE: The outputs of Solver.Execute node are always NULL when in FastDisplay mode)
execute_2 = DynaShape.ZeroTouch.Solver.Execute(solver=create, goals=join, geometryBinders=join_2, iterations=iterations, reset=reset, execute=execute, enableMomentum=momentum, enableFastDisplay=fast_display, enableManipulation=manipulate)
watch = Watch(execute_2.geometries)
watch_2 = Watch(execute_2.nodePositions)
