# Dynamo graph 12_ConstantPressure_PneumaticStructure.dyn "12_ConstantPressure" (Dynamo 3.0.4.7905)
# packages: DynaShape 0.9.0.0, MeshToolkit 5.0.0

# group: Anchors
code_block = CodeBlock()
# ---------- code_block.designscript (6 lines) ----------
A = Point.ByCoordinates(-30..30..1, -30, 0);
B = Point.ByCoordinates(-30..30..1, 30, 0);
C = Point.ByCoordinates(-30, -29..29..1, 0);
D = Point.ByCoordinates(30, -29..29..1, 0);
E = Point.ByCoordinates(-15..15..15, 12, 0);
F = Point.ByCoordinates(-10..10..20, -12, 0);
# ----------------------------------------
join = List.Join(list0=code_block.A, list1=code_block.B, list2=code_block.C, list3=code_block.D, list4=code_block.E, list5=code_block.F)
create = DynaShape.ZeroTouch.Goals.AnchorGoal.Create(startPosition=join)

byOrigin = CoordinateSystem.ByOrigin()
number = DoubleInput(60)  # graph input
planeMesh = DynaShape.ZeroTouch.Utilities.PlaneMesh(cs=byOrigin, lengthX=number, lengthY=number, divX=number, divY=number)

# group: Pressure acting on each triangular face of the mesh. The strength of the force equals the pressure value multiplied by the area of the triangle.
create_2 = DynaShape.ZeroTouch.Goals.ConstantPressureGoal.Create(mesh=planeMesh.mesh)
number_slider = DoubleSlider(0.025, range=0..0.04 step 0.001)  # graph input
change = DynaShape.ZeroTouch.Goals.ConstantPressureGoal.Change(constantPressureGoal=create_2, pressure=number_slider)

edges = Autodesk.Dynamo.MeshToolkit.Mesh.Edges(mesh=planeMesh.mesh)

# group: Length goals that help the surface resist the stretching caused by pressure
create_3 = DynaShape.ZeroTouch.Goals.LengthGoal.Create(line=edges)

# group: Geometry binders for visualisation
lineBinder = DynaShape.ZeroTouch.GeometryBinders.LineBinder(line=edges)
meshBinder = DynaShape.ZeroTouch.GeometryBinders.MeshBinder(mesh=planeMesh.mesh)

# group: DynaShape Solver
# note: ************************************
# *** HOW TO RUN THE SOLVER ***
# 1. At the beginning of a scenario, set "reset" to True to reset the solver.
# 2. Set "reset" to False.
# 3. Set "execute" to True and see the nodes start moving to their "desired" positions as dictated by the "goals"
# (To "pause" the system at anytime, just set "execute" to False)
# 4. With "enableManipulaion" set to True, you can switch to Background View and grab and pull the nodes/vertices around
# 5. Once the system has reached the state that you like, pause the execution (i.e. by setting "execute" to False), and set "enableFastDisplay" to False so that the solver will output ACTUAL Dynamo geometry for further usage downstream
# (NOTE: The outputs of Solver.Execute node are always NULL when in FastDisplay mode)
create_4 = DynaShape.ZeroTouch.Solver.Create()
join_2 = List.Join(list0=create, list1=change, list2=create_3)
join_3 = List.Join(list0=lineBinder, list1=meshBinder)
iterations = DoubleSlider(1, range=0..400 step 1)  # graph input
reset = BoolSelector(true)  # graph input
execute = BoolSelector(true)  # graph input
momentum = BoolSelector(true)  # graph input
fast_display = BoolSelector(true)  # graph input
manipulate = BoolSelector(true)  # graph input
execute_2 = DynaShape.ZeroTouch.Solver.Execute(solver=create_4, goals=join_2, geometryBinders=join_3, iterations=iterations, reset=reset, execute=execute, enableMomentum=momentum, enableFastDisplay=fast_display, enableManipulation=manipulate)
