# Dynamo graph createChange.dyn (Dynamo 3.0.4.7905)

file_path = Filename("D:\repos_john\DynaShape\DynaShape\DynaShape\ZeroTouch\Goals\ConvexPolygonCollisionGoal.cs")
string = StringInput("D:\repos_john\DynaShape\DynaShape\DynaShape\ZeroTouch\Goals")
directory_from_path = DirectoryObject(path=string)
getDirectoryContents = FileSystem.GetDirectoryContents(directory=directory_from_path)
code_block = CodeBlock { 7; }
dropItems = List.DropItems(list=getDirectoryContents.files, amount=code_block)
readText = FileSystem.ReadText(file=dropItems)
code_block_2 = CodeBlock { false; }
fileName = FileSystem.FileName(path=dropItems, withExtension=code_block_2)
code_block_3 = CodeBlock(x=fileName) { cr = "Create"; ch = "Change"; x + "_" + cr; x + "_" +ch; }
replace = String.Replace(string=readText, searchFor=code_block_3.out2, replaceWith=code_block_3.cr)
replace_2 = String.Replace(string=replace, searchFor=code_block_3.out3, replaceWith=code_block_3.ch)
writeText = FileSystem.WriteText(filePath=dropItems, text=replace_2)
