# Dynamo graph createClasses.dyn (Dynamo 3.0.4.7905)

string = StringInput("D:\repos_john\DynaShape\DynaShape\DynaShape\ZeroTouch\Goals\")
string_2 = StringInput("""  //==================================================================
  // ConvexPolygonCollisionGoal
  //==================================================================

  /// <summary>
  ///
  /// </summary>
  /// <param name="centers"></param>
  /// <param name="radii"></param>
  /// <param name="polygonVertices"></param>
  /// <param name="weight"></param>
  /// <returns></returns>
  public static ConvexPolygonCollisionGoal ConvexPolygonCollisionGoal_Create(
      List<Point> centers,
      List<float> radii,
      [DefaultArgument("null")] List<Point> polygonVertices,
      [DefaultArgument("1000.0")] float weight)
  {
      if (centers.Count != radii.Count)
          throw new Exception("Error: centers count is not equal to radii count");
      return new ConvexPolygonCollisionGoal(
          centers.ToTriples(),
          radii,
          polygonVertices == null ? new List<Triple>() : polygonVertices.ToTriples(),
          weight);
  }

  /// <summary>
  ///
  /// </summary>
  /// <param name="goal"></param>
  /// <param name="radii"></param>
  /// <param name="polygonVertices"></param>
  /// <param name="weight"></param>
  /// <returns></returns>
  public static ConvexPolygonCollisionGoal ConvexPolygonCollisionGoal_Change(
      ConvexPolygonCollisionGoal goal,
      [DefaultArgument("null")] List<float> radii,
      [DefaultArgument("null")] List<Point> polygonVertices,
      [DefaultArgument("-1.0")] float weight)
  {
      if (radii != null)
      {
          if (goal.NodeCount != radii.Count)
              throw new Exception("Error: radii count is not equal to node count");
          goal.Radii = radii.ToArray();
      }

      if (polygonVertices != null) goal.PolygonVertices = polygonVertices.ToTriples();
      if (weight >= 0.0) goal.Weight = weight;
      return goal;
  }


  //==================================================================
  // ConvexPolygonContainmentGoal
  //==================================================================

  /// <summary>
  ///
  /// </summary>
  /// <param name="centers"></param>
  /// <param name="radii"></param>
  /// <param name="polygonVertices"></param>
  /// <param name="weight"></param>
  /// <returns></returns>
  public static ConvexPolygonContainmentGoal ConvexPolygonContainmentGoal_Create(
      List<Point> centers,
      List<float> radii,
      [DefaultArgument("null")] List<Point> polygonVertices,
      [DefaultArgument("1000.0")] float weight)
  {
      if (centers.Count != radii.Count)
          throw new Exception("Error: centers count is not equal to radii count");
      return new ConvexPolygonContainmentGoal(
          centers.ToTriples(),
          radii,
          polygonVertices == null ? new List<Triple>() : polygonVertices.ToTriples(),
          weight);
  }

  /// <summary>
  ///
  /// </summary>
  /// <param name="goal"></param>
  /// <param name="radii"></param>
  /// <param name="polygonVertices"></param>
  /// <param name="weight"></param>
  /// <returns></returns>
  public static ConvexPolygonContainmentGoal ConvexPolygonContainmentGoal_Change(
      ConvexPolygonContainmentGoal goal,
      [DefaultArgument("null")] List<float> radii,
      [DefaultArgument("null")] List<Point> polygonVertices,
      [DefaultArgument("-1.0")] float weight)
  {
      if (radii != null)
      {
          if (goal.NodeCount != radii.Count)
              throw new Exception("Error: radii count is not equal to node count");
          goal.Radii = radii.ToArray();
      }

      if (polygonVertices != null) goal.PolygonVertices = polygonVertices.ToTriples();
      if (weight >= 0.0) goal.Weight = weight;
      return goal;
  }



  //==================================================================
  // CoPlanar
  //==================================================================

  /// <summary>
  /// Force a set of nodes to lie on a common plane.
  /// The plane position and orientation are computed based on the current node positions.
  /// This is different from the OnPlane goal, where the target plane is fixed and defined in advance.
  /// </summary>
  /// <param name="startPositions"></param>
  /// <param name="weight"></param>
  /// <returns></returns>
  public static CoPlanarGoal CoPlanarGoal_Create(
      List<Point> startPositions,
      [DefaultArgument("1.0")] float weight)
  {
      return new CoPlanarGoal(startPositions.ToTriples(), weight);
  }


  /// <summary>
  /// Adjust the goal's parameters while the solver is running.
  /// </summary>
  /// <param name="goal"></param>
  /// <param name="weight"></param>
  /// <returns></returns>
  public static CoPlanarGoal CoPlanarGoal_Change(
      CoPlanarGoal goal,
      [DefaultArgument("-1.0")] float weight)
  {
      if (weight >= 0.0) goal.Weight = weight;
      return goal;
  }


  //==================================================================
  // CoSpherical
  //==================================================================

  /// <summary>
  /// Force a set of nodes to lie on a common spherical surface.
  /// The sphere position and radius are computed based the current node positions
  /// </summary>
  /// <param name="startPositions"></param>
  /// <param name="weight"></param>
  /// <returns></returns>
  public static CoSphericalGoal CoSphericalGoal_Create(
      List<Point> startPositions,
      [DefaultArgument("1.0")] float weight)
  {
      return new CoSphericalGoal(startPositions.ToTriples(), weight);
  }


  /// <summary>
  /// Adjust the goal's parameters while the solver is running.
  /// </summary>
  /// <param name="goal"></param>
  /// <param name="weight"></param>
  /// <returns></returns>
  public static CoSphericalGoal CoSphericalGoal_Change(
      CoSphericalGoal goal,
      [DefaultArgument("-1.0")] float weight)
  {
      if (weight >= 0.0) goal.Weight = weight;
      return goal;
  }


  //==================================================================
  // Directional Wind
  //==================================================================

  /// <summary>
  /// Simulate wind by applying a constant force on the three vertices of a triangle,
  /// scaled by the cosine of the angle between the wind vector and the triangle's normal.
  /// This way, the wind has full effect when it hits the triangle head-on, and zero
  /// effect if it blows parallel to the triangle.
  /// </summary>
  /// <param name="startPosition1"></param>
  /// <param name="startPosition2"></param>
  /// <param name="startPosition3"></param>
  /// <param name="windVector"></param>
  /// <param name="weight"></param>
  /// <returns></returns>
  public static DirectionalWindGoal DirectionalWindGoal_Create(
      Point startPosition1,
      Point startPosition2,
      Point startPosition3,
      [DefaultArgument("Vector.ByCoordinates(1.0, 0, 0)")] Vector windVector,
      [DefaultArgument("1.0")] float weight)
  {
      return new DirectionalWindGoal(
          startPosition1.ToTriple(),
          startPosition2.ToTriple(),
          startPosition3.ToTriple(),
          windVector.ToTriple(),
          weight);
  }


  /// <summary>
  /// Simulate wind blowing along a specified direction, by applying a force on the three vertices of a triangle,
  /// The force magnitude is additionally scaled by the cosine of the angle between the wind vector and the triangle's normal.
  /// This way, the wind has full effect when it hits the triangle head-on, and zero
  /// effect if it blows parallel to the triangle.
  /// </summary>
  /// <param name="mesh"></param>
  /// <param name="windVector"></param>
  /// <param name="weight"></param>
  /// <returns></returns>
  public static List<DirectionalWindGoal> DirectionalWindGoal_Create(
      Mesh mesh,
      [DefaultArgument("Vector.ByCoordinates(1.0, 0, 0)")] Vector windVector,
      [DefaultArgument("1.0")] float weight)
  {
      List<DirectionalWindGoal> windGoals = new List<DirectionalWindGoal>();

      List<double> vertices = mesh.TrianglesAsNineNumbers.ToList();

      int faceCount = vertices.Count / 9;

      for (int i = 0; i < faceCount; i++)
      {
          int j = i * 9;
          windGoals.Add(
              new DirectionalWindGoal(
                  new Triple(vertices[j + 0], vertices[j + 1], vertices[j + 2]),
                  new Triple(vertices[j + 3], vertices[j + 4], vertices[j + 5]),
                  new Triple(vertices[j + 6], vertices[j + 7], vertices[j + 8]),
                  windVector.ToTriple(),
                  weight));
      }

      return windGoals;
  }


  /// <summary>
  /// Adjust the goal's parameters while the solver is running.
  /// </summary>
  /// <param name="goal"></param>
  /// <param name="windVector"></param>
  /// <param name="weight"></param>
  /// <returns></returns>
  public static DirectionalWindGoal DirectionalWindGoal_Change(
      DirectionalWindGoal goal,
      [DefaultArgument("null")] Vector windVector,
      [DefaultArgument("-1.0")] float weight)
  {
      if (windVector != null) goal.WindVector = windVector.ToTriple();
      if (weight >= 0.0) goal.Weight = weight;
      return goal;
  }


  //==================================================================
  // Direction
  //==================================================================

  /// <summary>
  /// Force the line connecting two nodes to be parallel to the specified direction.
  /// </summary>
  /// <param name="startPosition1"></param>
  /// <param name="startPosition2"></param>
  /// <param name="targetDirection"></param>
  /// <param name="weight"></param>
  /// <returns></returns>
  public static DirectionGoal DirectionGoal_Create(
      Point startPosition1,
      Point startPosition2,
      [DefaultArgument("null")] Vector targetDirection,
      [DefaultArgument("1.0")] float weight)
  {
      return new DirectionGoal(
          startPosition1.ToTriple(),
          startPosition2.ToTriple(),
          targetDirection?.ToTriple() ?? (startPosition2.ToTriple() - startPosition1.ToTriple()).Normalise(),
          weight);
  }


  /// <summary>
  /// Adjust the goal's parameters while the solver is running.
  /// </summary>
  /// <param name="goal"></param>
  /// <param name="targetDirection"></param>
  /// <param name="weight"></param>
  /// <returns></returns>
  public static DirectionGoal DirectionGoal_Change(
      DirectionGoal goal,
      [DefaultArgument("null")] Vector targetDirection,
      [DefaultArgument("-1.0")] float weight)
  {
      if (targetDirection != null) goal.TargetDirection = targetDirection.ToTriple();
      if (weight >= 0.0) goal.Weight = weight;
      return goal;
  }


  //==================================================================
  // EqualLength
  //==================================================================

  /// <summary>
  /// Force a sequence of nodes to maintain equal distances.
  /// </summary>
  /// <param name="startPositions"></param>
  /// <param name="weight"></param>
  /// <returns></returns>
  public static EqualLengthsGoal EqualLengthsGoal_Create(
      List<Point> startPositions,
      [DefaultArgument("1.0")] float weight)
  {
      List<Triple> triples = new List<Triple> { startPositions[0].ToTriple() };

      for (int i = 1; i < startPositions.Count - 1; i++)
      {
          triples.Add(startPositions[i].ToTriple());
          triples.Add(triples[triples.Count - 1]);
      }

      triples.Add(startPositions[startPositions.Count - 1].ToTriple());

      return new EqualLengthsGoal(triples, weight);
  }


  /// <summary>
  /// Force a set of line segments to maintain equal lengths.
  /// </summary>
  /// <param name="lineStarts"></param>
  /// <param name="lineEnds"></param>
  /// <param name="weight"></param>
  /// <returns></returns>
  public static EqualLengthsGoal EqualLengthsGoal_Create(
      List<Point> lineStarts,
      List<Point> lineEnds,
      [DefaultArgument("1.0")] float weight)
  {
      List<Triple> triples = new List<Triple>();

      int n = lineStarts.Count < lineEnds.Count ? lineStarts.Count : lineEnds.Count;

      for (int i = 0; i < n; i++)
      {
          triples.Add(lineStarts[i].ToTriple());
          triples.Add(lineEnds[i].ToTriple());
      }

      return new EqualLengthsGoal(triples, weight);
  }


  /// <summary>
  /// Force a set of line segments to maintain equal lengths.
  /// </summary>
  /// <param name="lines"></param>
  /// <param name="weight"></param>
  /// <returns></returns>
  public static EqualLengthsGoal EqualLengthsGoal_Create(
      List<Line> lines,
      [DefaultArgument("1.0")] float weight)
  {
      List<Triple> startPositions = new List<Triple>();
      foreach (Line line in lines)
      {
          startPositions.Add(line.StartPoint.ToTriple());
          startPositions.Add(line.EndPoint.ToTriple());
      }
      return new EqualLengthsGoal(startPositions, weight);
  }


  /// <summary>
  /// Adjust the goal's parameters while the solver is running.
  /// </summary>
  /// <param name="goal"></param>
  /// <param name="weight"></param>
  /// <returns></returns>
  public static EqualLengthsGoal EqualLengthsGoal_Change(
      EqualLengthsGoal goal,
      [DefaultArgument("-1.0")] float weight)
  {
      if (weight >= 1.0) goal.Weight = weight;
      return goal;
  }


  //==================================================================
  // Floor
  //==================================================================

  /// <summary>
  /// Force a set of nodes to stay above a horizontal floor plane.
  /// </summary>
  /// <param name="startPositions"></param>
  /// <param name="floorHeight"></param>
  /// <param name="weight"></param>
  /// <returns></returns>
  public static FloorGoal FloorGoal_Create(
      List<Point> startPositions,
      [DefaultArgument("0.0")] float floorHeight,
      [DefaultArgument("1000.0")] float weight)
  {
      return new FloorGoal(startPositions.ToTriples(), floorHeight, weight);
  }


  /// <summary>
  /// Adjust the goal's parameters while the solver is running.
  /// </summary>
  /// <param name="goal"></param>
  /// <param name="floorHeight"></param>
  /// <param name="weight"></param>
  /// <returns></returns>
  public static FloorGoal FloorGoal_Change(
      FloorGoal goal,
      [DefaultArgument("0.0")] float floorHeight,
      [DefaultArgument("-1.0")] float weight)
  {
      goal.FloorHeight = floorHeight;
      if (weight > 0.0) goal.Weight = weight;
      return goal;
  }


  //==================================================================
  // Length
  //==================================================================

  /// <summary>
  /// Force a pair of nodes to maintain the specified distance/length
  /// </summary>
  /// <param name="startPosition1"></param>
  /// <param name="startPosition2"></param>
  /// <param name="targetLength">If unspecified, the target length will be the distance between the starting node positions</param>
  /// <param name="weight"></param>
  /// <returns></returns>
  public static LengthGoal LengthGoal_Create(
      Point startPosition1,
      Point startPosition2,
      [DefaultArgument("-1.0")] float targetLength,
      [DefaultArgument("1.0")] float weight)
  {
      return new LengthGoal(
          startPosition1.ToTriple(),
          startPosition2.ToTriple(),
          targetLength >= 0.0
              ? targetLength
              : (startPosition2.ToTriple() - startPosition1.ToTriple()).Length,
          weight);
  }


  /// <summary>
  /// Maintain the specified distance between two nodes located at the start and end of the given line
  /// </summary>
  /// <param name="line">This line will be used to create two nodes located at is start and end point</param>
  /// <param name="targetLength">If unspecified, the target length will be the distance between the starting node positions</param>
  /// <param name="weight"></param>
  /// <returns></returns>
  public static LengthGoal LengthGoal_Create(
      Line line,
      [DefaultArgument("-1.0")] float targetLength,
      [DefaultArgument("1.0")] float weight)
  {
      return new LengthGoal(
          line.StartPoint.ToTriple(),
          line.EndPoint.ToTriple(),
          targetLength >= 0.0 ? targetLength : (float)line.Length,
          weight);
  }


  /// <summary>
  /// Adjust the goal's parameters while the solver is running.
  /// </summary>
  /// <param name="goal"></param>
  /// <param name="targetLength"></param>
  /// <param name="weight"></param>
  /// <returns></returns>
  public static LengthGoal LengthGoal_Change(
      LengthGoal goal,
      [DefaultArgument("-1.0")] float targetLength,
      [DefaultArgument("-1.0")] float weight)
  {
      if (targetLength >= 0.0) goal.TargetLength = targetLength;
      if (weight >= 0.0) goal.Weight = weight;
      return goal;
  }


  //==================================================================
  // Merge
  //==================================================================

  /// <summary>
  /// Pull a set of nodes to their center of mass.
  /// This is useful to force the nodes to have coincident positions.
  /// By default the weight value is set very high to ensure that the nodes really merge together at one position.
  /// </summary>
  /// <param name="startPositions"></param>
  /// <param name="weight"></param>
  /// <returns></returns>
  public static MergeGoal MergeGoal_Create(
      List<Point> startPositions,
      [DefaultArgument("1000.0")] float weight)
  {
      return new MergeGoal(startPositions.ToTriples(), weight);
  }


  /// <summary>
  /// Adjust the goal's parameters while the solver is running.
  /// </summary>
  /// <param name="goal"></param>
  /// <param name="weight"></param>
  /// <returns></returns>
  public static MergeGoal MergeGoal_Change(
      MergeGoal goal,
      [DefaultArgument("-1.0")] float weight)
  {
      if (weight >= 0.0) goal.Weight = weight;
      return goal;
  }


  //==================================================================
  // OnCurve
  //==================================================================

  /// <summary>
  /// Force a set of nodes to lie on the specified curve.
  /// </summary>
  /// <param name="startPositions"></param>
  /// <param name="targetCurve"></param>
  /// <param name="weight"></param>
  /// <returns></returns>
  public static OnCurveGoal OnCurveGoal_Create(
      List<Point> startPositions,
      Curve targetCurve,
      [DefaultArgument("1.0")] float weight)
  {
      return new OnCurveGoal(startPositions.ToTriples(), targetCurve, weight);
  }


  /// <summary>
  /// Adjust the goal's parameters while the solver is running.
  /// </summary>
  /// <param name="goal"></param>
  /// <param name="targetCurve"></param>
  /// <param name="weight"></param>
  /// <returns></returns>
  public static OnCurveGoal OnCurveGoal_Change(
      OnCurveGoal goal,
      [DefaultArgument("null")] Curve targetCurve,
      float weight)
  {
      if (targetCurve != null) goal.TargetCurve = targetCurve;
      if (weight >= 0.0) goal.Weight = weight;
      return goal;
  }


  //==================================================================
  // OnLine
  //==================================================================

  /// <summary>
  /// Force a set of nodes to lie on the specified line.
  /// This is different from other CoLinear goal, where the target line is computed based on the current node positions rather than being defined and fixed in advance.
  /// </summary>
  /// <param name="startPosition"></param>
  /// <param name="targetLineOrigin"></param>
  /// <param name="targetLineDirection"></param>
  /// <param name="weight"></param>
  /// <returns></returns>
  public static OnLineGoal OnLineGoal_Create(
      List<Point> startPosition,
      [DefaultArgument("Point.Origin()")] Point targetLineOrigin,
      [DefaultArgument("Vector.XAxis()")] Vector targetLineDirection,
      [DefaultArgument("1.0")] float weight)
  {
      return new OnLineGoal(
          startPosition.ToTriples(),

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""")
string_3 = StringInput("public static ")
split = String.Split(string=string_2, separator0=string_3)
string_4 = StringInput(" ")
split_2 = String.Split(string=split, separator0=string_4)
code_block = CodeBlock { 1; }
dropItems = List.DropItems(list=split_2, amount=code_block)
firstItem = List.FirstItem(list=dropItems@L2)
uniqueItems = List.UniqueItems(list=firstItem)
code_block_2 = CodeBlock(a=string, b=uniqueItems) { a + b + ".cs"; }
string_5 = StringInput("""using System;
using System.Collections.Generic;
using System.Linq;
using System.Text;
using System.Threading.Tasks;

namespace DynaShape.ZeroTouch.Goals
{
    /// <summary>
    /// Class1
    /// </summary>
    public  class Class1
    {
        private Class1(){}

    }
}
""")
string_6 = StringInput("Class1")
replace = String.Replace(string=string_5, searchFor=string_6, replaceWith=uniqueItems@L1)
writeText = FileSystem.WriteText(filePath=code_block_2, text=replace)
